# Grasshopper definition PromptMorph_Case_Studies_Python_Scripts_Grasshopper.gh (Grasshopper 1.0.7)

pt = Point(Point(6.184108564, 15.02606079, -2.532837525))
iteration_1_3 = GhPythonScript(
    AttractorPoint=pt,
    GridSize=Slider(20, range=0..20),
    MaxRadius=Slider(0.5, range=0..10),
    ScaleFactor=Slider(1, range=0.5..2))  # -> a; inputs GridSize: Int32
# ---------- iteration_1_3: Python ----------
import rhinoscriptsyntax as rs
        
# Inputs
# AttractorPoint: The red point acting as an attractor
# GridSize: Number of rows and columns in the grid
# MaxRadius: Maximum radius of spheres
# ScaleFactor: Controls how quickly the radius changes with distance
        
# Parameters
attractor_point = AttractorPoint  # Attractor point
grid_size = GridSize  # Grid size (number of rows and columns)
max_radius = MaxRadius  # Maximum sphere radius
scale_factor = ScaleFactor  # Scaling effect factor (higher = more pronounced effect)
        
# Output list for spheres
spheres = []
        
# Loop to create the grid of points and calculate sphere radius based on distance
for i in range(grid_size):
    for j in range(grid_size):
        # Grid point coordinates
        x = i
        y = j
        z = 0  # All spheres lie on the XY plane; you can parameterize Z if needed
        grid_point = rs.AddPoint(x, y, z)
                
        # Calculate distance to attractor
        distance = rs.Distance(grid_point, attractor_point)
                
        # Calculate sphere radius: closer = smaller, farther = larger
        radius = max_radius * (distance / (grid_size * scale_factor))  # Normalize distance effect
                
        # Ensure radius is within valid bounds
        if radius < 0:
            radius = 0
        elif radius > max_radius:
            radius = max_radius
                
        # Create sphere
        sphere = rs.AddSphere(grid_point, radius)
        spheres.append(sphere)
        
# Output the spheres
a = spheres
# ---------- end iteration_1_3 ----------

# ----
# Case Study 1:  Point-Attractor Grid (p.114)
number_slider = Slider(8, range=0..10)
pt_2 = Point(Point(19.04870255, 9.10298387, 0))
iteration_1_1 = GhPythonScript(AttractorPoint=pt_2, GridSize=number_slider, MaxRadius=Slider(1, range=0..10))  # -> out, a; inputs GridSize: Int32
# ---------- iteration_1_1: Python ----------
import rhinoscriptsyntax as rs
import math

# Inputs: AttractorPoint (red point), GridSize (number of rows/columns in grid), MaxRadius (largest circle radius)

# Parameters
attractor_point = AttractorPoint  # The red attractor point input
grid_size = GridSize  # Number of rows and columns in the grid
max_radius = MaxRadius  # Maximum radius of circles

# Output list for circles
circles = []

# Loop to create the grid of points and calculate circle radius based on distance
for i in range(grid_size):
    for j in range(grid_size):
        # Grid point coordinates
        x = i
        y = j
        grid_point = rs.AddPoint(x, y, 0)
        
        # Calculate distance to attractor
        distance = rs.Distance(grid_point, attractor_point)
        
        # Calculate circle radius (inverse relationship with distance)
        radius = max_radius * (1 - (distance / (grid_size * 1.5)))  # Normalize the distance effect
        
        # Ensure radius is non-negative
        if radius < 0:
            radius = 0
            
        # Create circle
        circle = rs.AddCircle(grid_point, radius)
        circles.append(circle)

# Output the circles
a = circles
# ---------- end iteration_1_1 ----------

pt_3 = Point(Point(18.20989512, 9.10298387, 0))
iteration_1_2 = GhPythonScript(AttractorPoint=pt_3, GridSize=Slider(17, range=0..20), MaxRadius=Slider(0.59, range=0..10))  # -> out, a; inputs GridSize: Int32
# ---------- iteration_1_2: Python ----------
import rhinoscriptsyntax as rs

# Inputs: AttractorPoint (red point), GridSize (number of rows/columns in grid), MaxRadius (largest circle radius)

# Parameters
attractor_point = AttractorPoint  # The red attractor point input
grid_size = GridSize  # Number of rows and columns in the grid
max_radius = MaxRadius  # Maximum radius of circles

# Output list for circles
circles = []

# Loop to create the grid of points and calculate circle radius based on distance
for i in range(grid_size):
    for j in range(grid_size):
        # Grid point coordinates
        x = i
        y = j
        grid_point = rs.AddPoint(x, y, 0)
        
        # Calculate distance to attractor
        distance = rs.Distance(grid_point, attractor_point)
        
        # Calculate circle radius (proportional to distance)
        # Closer = smaller, Farther = larger
        radius = max_radius * (distance / (grid_size * 1.5))  # Normalize the distance effect
        
        # Ensure radius is non-negative
        if radius < 0:
            radius = 0
            
        # Create circle
        circle = rs.AddCircle(grid_point, radius)
        circles.append(circle)

# Output the circles
a = circles
# ---------- end iteration_1_2 ----------

crv = Curve(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)
iteration_2_4 = GhPythonScript(
    line=crv,
    grid_size=Slider(20, range=0..100),
    spacing=Slider(2, range=0..10),
    min_size=Slider(0, range=0..10),
    max_size=Slider(1.5, range=0..10))  # -> out, a, b, c; inputs grid_size: Int32
# ---------- iteration_2_4: Python ----------
import rhinoscriptsyntax as rs
import Rhino.Geometry as rg

# Inputs:
# line (Guid): Attractor curve input from Grasshopper
# grid_size (int): Number of rows and columns for the grid
# spacing (float): Spacing between grid points
# max_size (float): Maximum size of circles
# min_size (float): Minimum size of circles

# Outputs:
# points (list): Grid of points
# sizes (list): List of sizes for the grid points
# circles (list): Circles representing the points with sizes

# Ensure the line input is converted to a Rhino.Geometry.Curve
line_curve = rs.coercecurve(line)

# Initialize empty lists
points = []
sizes = []
circles = []

if line_curve:  # Ensure the line exists
    # Generate grid points
    for i in range(grid_size):
        for j in range(grid_size):
            # Calculate grid point position
            x = i * spacing
            y = j * spacing
            pt = rg.Point3d(x, y, 0)

            # Calculate the closest point on the curve and its distance
            closest_param = line_curve.ClosestPoint(pt)[1]  # Extract the parameter
            closest_pt_geom = line_curve.PointAt(closest_param)  # Get the 3D point
            distance = pt.DistanceTo(closest_pt_geom)

            # Normalize the distance to map sizes
            max_distance = grid_size * spacing  # Estimate max possible distance
            normalized_distance = distance / max_distance
            
            # Map normalized distance to circle size (inverse relationship)
            size = min_size + (max_size - min_size) * normalized_distance

            # Store data
            points.append(pt)
            sizes.append(size)
            circles.append(rg.Circle(pt, size))

# Outputs
a = points  # Grid points
b = sizes   # Sizes of circles
c = circles # Circles as geometry
# ---------- end iteration_2_4 ----------
geo = Geometry(iteration_2_4.c)

crv_2 = Curve(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)
iteration_2_5 = GhPythonScript(
    line=crv_2,
    grid_size=Slider(20, range=0..100),
    spacing=Slider(2, range=0..10),
    min_size=Slider(0.15, range=0..10),
    max_size=Slider(1.5, range=0..10))  # -> out, a, b, c; inputs grid_size: Int32
# ---------- iteration_2_5: Python ----------
import rhinoscriptsyntax as rs
import Rhino.Geometry as rg

# Inputs:
# line (Guid): Attractor curve input from Grasshopper
# grid_size (int): Number of rows and columns for the grid
# spacing (float): Spacing between grid points
# max_size (float): Maximum size of spheres
# min_size (float): Minimum size of spheres

# Outputs:
# points (list): Grid of points
# sizes (list): List of sizes for the grid points
# spheres (list): Spheres representing the points with sizes

# Ensure the line input is converted to a Rhino.Geometry.Curve
line_curve = rs.coercecurve(line)

# Initialize empty lists
points = []
sizes = []
spheres = []

if line_curve:  # Ensure the line exists
    # Generate grid points
    for i in range(grid_size):
        for j in range(grid_size):
            # Calculate grid point position
            x = i * spacing
            y = j * spacing
            pt = rg.Point3d(x, y, 0)

            # Calculate the closest point on the curve and its distance
            closest_param = line_curve.ClosestPoint(pt)[1]  # Extract the parameter
            closest_pt_geom = line_curve.PointAt(closest_param)  # Get the 3D point
            distance = pt.DistanceTo(closest_pt_geom)

            # Normalize the distance to map sizes
            max_distance = grid_size * spacing  # Estimate max possible distance
            normalized_distance = distance / max_distance
            
            # Map normalized distance to sphere radius (inverse relationship)
            radius = min_size + (max_size - min_size) * normalized_distance

            # Store data
            points.append(pt)
            sizes.append(radius)
            spheres.append(rg.Sphere(pt, radius))

# Outputs
a = points  # Grid points
b = sizes   # Sizes (radii) of spheres
c = spheres # Spheres as geometry
# ---------- end iteration_2_5 ----------
geo_2 = Geometry(iteration_2_5.c)

crv_3 = Curve(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)
iteration_2_3 = GhPythonScript(line=crv_3, grid_size=Slider(20, range=0..100), spacing=Slider(2, range=0..10), max_size=Slider(2, range=0..10))  # -> out, a, b, c; inputs grid_size: Int32
# ---------- iteration_2_3: Python ----------
import rhinoscriptsyntax as rs
import Rhino.Geometry as rg

# Inputs:
# line (Guid): Attractor curve input from Grasshopper
# grid_size (int): Number of rows and columns for the grid
# spacing (float): Spacing between grid points
# max_size (float): Maximum size of points

# Output:
# points (list): Grid of points
# sizes (list): List of sizes for the grid points
# circles (list): Circles representing the points with sizes

# Ensure the line input is converted to a Rhino.Geometry.Curve
line_curve = rs.coercecurve(line)

# Initialize empty lists
points = []
sizes = []
circles = []

if line_curve:  # Ensure the line exists
    # Generate grid points
    for i in range(grid_size):
        for j in range(grid_size):
            # Calculate grid point position
            x = i * spacing
            y = j * spacing
            pt = rg.Point3d(x, y, 0)

            # Calculate the closest point on the curve and its distance
            closest_param = line_curve.ClosestPoint(pt)[1]  # Extract the parameter
            closest_pt_geom = line_curve.PointAt(closest_param)  # Get the 3D point
            distance = pt.DistanceTo(closest_pt_geom)

            # Map distance to size (inverse relationship)
            size = max_size * (1 - (distance / (grid_size * spacing)))
            size = max(size, 0.1)  # Prevent size from going negative

            # Store data
            points.append(pt)
            sizes.append(size)
            circles.append(rg.Circle(pt, size))

# Outputs
a = points  # Grid points
b = sizes   # Sizes of circles
c = circles # Circles as geometry
# ---------- end iteration_2_3 ----------

# ----
# Case Study 2:  Curve-Attractor Grid (p.115)
number_slider_2 = Slider(20, range=0..100)
crv_4 = Curve(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)
iteration_2_1 = GhPythonScript(line=crv_4, grid_size=number_slider_2, spacing=Slider(2, range=0..10), max_size=Slider(2, range=0..10))  # -> out, a, b, c; inputs grid_size: Int32
# ---------- iteration_2_1: Python ----------
import rhinoscriptsyntax as rs
import Rhino.Geometry as rg

# Inputs:
# line (Curve): Attractor curve
# grid_size (int): Number of rows and columns for the grid
# spacing (float): Spacing between grid points
# max_size (float): Maximum size of points

# Output:
# points (list): Grid of points
# sizes (list): List of sizes for the grid points
# circles (list): Circles representing the points with sizes

# Initialize empty lists
points = []
sizes = []
circles = []

# Generate grid points
for i in range(grid_size):
    for j in range(grid_size):
        # Calculate grid point position
        x = i * spacing
        y = j * spacing
        pt = rg.Point3d(x, y, 0)
        
        # Calculate the distance to the attractor line
        closest_pt = line.ClosestPoint(pt)
        distance = pt.DistanceTo(closest_pt)
        
        # Map distance to size (inverse relationship)
        size = max_size * (1 - (distance / (grid_size * spacing)))
        size = max(size, 0.1)  # Prevent size from going negative
        
        # Store data
        points.append(pt)
        sizes.append(size)
        circles.append(rg.Circle(pt, size))

# Outputs
a = points  # Grid points
b = sizes   # Sizes of circles
c = circles # Circles as geometry
# ---------- end iteration_2_1 ----------

crv_5 = Curve(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)
iteration_2_2 = GhPythonScript(line=crv_5, grid_size=Slider(20, range=0..100), spacing=Slider(2, range=0..10), max_size=Slider(2, range=0..10))  # -> out, a, b, c; inputs grid_size: Int32
# ---------- iteration_2_2: Python ----------
import rhinoscriptsyntax as rs
import Rhino.Geometry as rg

# Inputs:
# line (Guid): Attractor curve input from Grasshopper
# grid_size (int): Number of rows and columns for the grid
# spacing (float): Spacing between grid points
# max_size (float): Maximum size of points

# Output:
# points (list): Grid of points
# sizes (list): List of sizes for the grid points
# circles (list): Circles representing the points with sizes

# Ensure the line input is converted to a Rhino.Geometry.Curve
line_curve = rs.coercecurve(line)

# Initialize empty lists
points = []
sizes = []
circles = []

if line_curve:  # Ensure the line exists
    # Generate grid points
    for i in range(grid_size):
        for j in range(grid_size):
            # Calculate grid point position
            x = i * spacing
            y = j * spacing
            pt = rg.Point3d(x, y, 0)

            # Calculate the distance to the attractor line
            closest_pt = line_curve.ClosestPoint(pt)  # Closest point on the curve
            closest_pt_geom = line_curve.PointAt(closest_pt)  # Convert parameter to 3D point
            distance = pt.DistanceTo(closest_pt_geom)

            # Map distance to size (inverse relationship)
            size = max_size * (1 - (distance / (grid_size * spacing)))
            size = max(size, 0.1)  # Prevent size from going negative

            # Store data
            points.append(pt)
            sizes.append(size)
            circles.append(rg.Circle(pt, size))

# Outputs
a = points  # Grid points
b = sizes   # Sizes of circles
c = circles # Circles as geometry
# ---------- end iteration_2_2 ----------

iteration_3_2 = GhPythonScript(
    x=Slider(4.4, range=0..10),
    y=Slider(0.9, range=0..10),
    z=Slider(2.9, range=0..10),
    gx=Slider(0.2, range=0..1),
    gy=Slider(0.3, range=0..1),
    gz=Slider(0.2, range=0..1),
    r=Slider(30, range=0..30),
    c=Slider(15, range=0..20),
    l=Slider(1, range=1..10))  # -> out, a; inputs r: Int32, c: Int32, l: Int32
# ---------- iteration_3_2: Python ----------
import rhinoscriptsyntax as rs

# Inputs from Grasshopper
brick_length = x  # Length of each brick
brick_height = y  # Height of each brick
brick_depth = z   # Depth of each brick
gap_x = gx        # Gap between bricks horizontally
gap_y = gy        # Gap between bricks vertically
gap_z = gz        # Gap between layers (depth)
rows = r          # Number of rows
cols = c          # Number of bricks per row
layers = l        # Number of layers (depth)

# Initialize list to store bricks
bricks = []

# Create 3D brick wall
for k in range(layers):  # Loop through layers (depth)
    for i in range(rows):  # Loop through rows
        for j in range(cols):  # Loop through columns
            # Calculate the x, y, and z position of each brick
            x_pos = j * (brick_length + gap_x)
            y_pos = i * (brick_height + gap_y)
            z_pos = k * (brick_depth + gap_z)
            
            # Apply staggering (offset) for alternate rows
            if i % 2 == 1:
                x_pos += (brick_length + gap_x) / 2

            # Create the brick as a box
            pt1 = rs.AddPoint(x_pos, y_pos, z_pos)
            pt2 = rs.AddPoint(x_pos + brick_length, y_pos, z_pos)
            pt3 = rs.AddPoint(x_pos + brick_length, y_pos + brick_height, z_pos)
            pt4 = rs.AddPoint(x_pos, y_pos + brick_height, z_pos)
            pt5 = rs.AddPoint(x_pos, y_pos, z_pos + brick_depth)
            pt6 = rs.AddPoint(x_pos + brick_length, y_pos, z_pos + brick_depth)
            pt7 = rs.AddPoint(x_pos + brick_length, y_pos + brick_height, z_pos + brick_depth)
            pt8 = rs.AddPoint(x_pos, y_pos + brick_height, z_pos + brick_depth)

            # Add the box (brick)
            brick = rs.AddBox([pt1, pt2, pt3, pt4, pt5, pt6, pt7, pt8])
            bricks.append(brick)

# Output the bricks
a = bricks
# ---------- end iteration_3_2 ----------

# ----
# Case Study 3:  Running Bond Tile Pattern (p.207)
iteration_3_1 = GhPythonScript()  # -> out, a
# ---------- iteration_3_1: Python ----------
import rhinoscriptsyntax as rs

# Parameters
brick_length = 2.0  # Length of each brick
brick_height = 1.0  # Height of each brick
gap_x = 0.2         # Gap between bricks horizontally
gap_y = 0.1         # Gap between bricks vertically
rows = 20           # Number of rows
cols = 50           # Number of bricks per row

# Lists to hold the rectangles
bricks = []

# Create bricks
for i in range(rows):
    for j in range(cols):
        # Calculate the x and y position of each brick
        x = j * (brick_length + gap_x)
        y = i * (brick_height + gap_y)
        
        # Apply staggering (offset) for alternate rows
        if i % 2 == 1:  
            x += (brick_length + gap_x) / 2

        # Create the rectangle for each brick
        pt1 = rs.AddPoint(x, y, 0)
        pt2 = rs.AddPoint(x + brick_length, y, 0)
        pt3 = rs.AddPoint(x + brick_length, y + brick_height, 0)
        pt4 = rs.AddPoint(x, y + brick_height, 0)

        # Add the rectangle
        brick = rs.AddPolyline([pt1, pt2, pt3, pt4, pt1])
        bricks.append(brick)

# Output the bricks
a = bricks
# ---------- end iteration_3_1 ----------

iteration_4_4 = GhPythonScript(
    radius=Slider(17, range=0..100),
    num_rings=Slider(24, range=0..100),
    num_divisions=Slider(37, range=0..100),
    height_factor=Slider(6, range=0..100))  # -> out, a, b, c, d, e; inputs num_rings: Int32, num_divisions: Int32
# ---------- iteration_4_4: Python ----------
import math
import Rhino.Geometry as rg

# Parameters (input these in Grasshopper)
# radius: Dome radius
# num_rings: Number of concentric rings
# num_divisions: Divisions per ring
# height_factor: Scaling factor for dome height

# Output lists
points = []
radial_lines = []      # Radial connections
circular_lines = []    # Circular connections
diagonal_lines_1 = []  # First diagonal connections (forward slash "/")
diagonal_lines_2 = []  # Second diagonal connections (backslash "\\")

# Generate points on the dome
for i in range(1, num_rings + 1):
    r = radius * (i / num_rings)  # Current ring radius
    ring_points = []
    for j in range(num_divisions):
        angle = 2 * math.pi * (j / num_divisions)
        x = r * math.cos(angle)
        y = r * math.sin(angle)
        z = height_factor * (1 - (r / radius)**2)  # Parabolic height
        ring_points.append(rg.Point3d(x, y, z))
    points.append(ring_points)

# Create connections to form the rhombus pattern
for i in range(len(points) - 1):
    for j in range(num_divisions):
        # Radial connections
        start = points[i][j]
        end = points[i + 1][j]
        radial_lines.append(rg.LineCurve(start, end))
        
        # Circular connections
        next_index = (j + 1) % num_divisions
        start = points[i][j]
        end = points[i][next_index]
        circular_lines.append(rg.LineCurve(start, end))
        
        # Diagonal connections (rhombus pattern)
        diagonal_1_start = points[i][j]
        diagonal_1_end = points[i + 1][(j + 1) % num_divisions]
        diagonal_lines_1.append(rg.LineCurve(diagonal_1_start, diagonal_1_end))
        
        diagonal_2_start = points[i][(j + 1) % num_divisions]
        diagonal_2_end = points[i + 1][j]
        diagonal_lines_2.append(rg.LineCurve(diagonal_2_start, diagonal_2_end))

# Output
a = points  # List of points for reference
b = radial_lines  # Radial connections
c = circular_lines  # Circular connections
d = diagonal_lines_1  # First diagonal (forward slash "/")
e = diagonal_lines_2  # Second diagonal (backslash "\\")
# ---------- end iteration_4_4 ----------
geo_3 = Geometry([iteration_4_4.d, iteration_4_4.e])

# ----
# The image references for each of the study cases are taken from the book AAD: Algorithms-Aided Design - Parametric Strategies using Grasshopper by Arturo Tedeschi.
# 
# 
# 
# 
# The scope is to reconstruct the geometry shown in the image references as a 3D parametric, editable model in Grasshopper through text-to-3D prompting in ChatGPT-4O, utilizing Python scripting within the GhPython component.
# Case Study 4:  Rhombus Dome Grid (p. 159)
iteration_4_1 = GhPythonScript()  # -> out, a, b
# ---------- iteration_4_1: Python ----------
import math
import Rhino.Geometry as rg

# Parameters
radius = 10  # Dome radius
num_rings = 20  # Number of concentric rings
num_divisions = 40  # Divisions per ring
height_factor = 2  # Scaling factor for dome height

# Output lists
points = []
curves = []

# Generate points on the dome
for i in range(1, num_rings + 1):
    r = radius * (i / num_rings)  # Current ring radius
    ring_points = []
    for j in range(num_divisions):
        angle = 2 * math.pi * (j / num_divisions)
        x = r * math.cos(angle)
        y = r * math.sin(angle)
        z = height_factor * (1 - (r / radius)**2)  # Parabolic height
        ring_points.append(rg.Point3d(x, y, z))
    points.append(ring_points)

# Connect points to form the lattice structure
for i in range(len(points) - 1):
    for j in range(num_divisions):
        # Radial connections
        start = points[i][j]
        end = points[i + 1][j]
        curves.append(rg.LineCurve(start, end))
        
        # Circular connections
        next_index = (j + 1) % num_divisions
        start = points[i][j]
        end = points[i][next_index]
        curves.append(rg.LineCurve(start, end))

# Output
a = points  # List of points for reference
b = curves  # Lattice structure as line curves
# ---------- end iteration_4_1 ----------
iteration_4_2 = GhPythonScript()  # -> out, a, b
# ---------- iteration_4_2: Python ----------
import math
import Rhino.Geometry as rg

# Parameters
radius = 10  # Dome radius
num_rings = 20  # Number of concentric rings
num_divisions = 40  # Divisions per ring
height_factor = 2  # Scaling factor for dome height

# Output lists
points = []
curves = []

# Generate points on the dome
for i in range(1, num_rings + 1):
    r = radius * (i / num_rings)  # Current ring radius
    ring_points = []
    for j in range(num_divisions):
        angle = 2 * math.pi * (j / num_divisions)
        x = r * math.cos(angle)
        y = r * math.sin(angle)
        z = height_factor * (1 - (r / radius)**2)  # Parabolic height
        ring_points.append(rg.Point3d(x, y, z))
    points.append(ring_points)

# Create connections to form the rhombus pattern
for i in range(len(points) - 1):
    for j in range(num_divisions):
        # Radial connections
        start = points[i][j]
        end = points[i + 1][j]
        curves.append(rg.LineCurve(start, end))
        
        # Circular connections
        next_index = (j + 1) % num_divisions
        start = points[i][j]
        end = points[i][next_index]
        curves.append(rg.LineCurve(start, end))
        
        # Diagonal connections (rhombus pattern)
        diagonal_1_start = points[i][j]
        diagonal_1_end = points[i + 1][(j + 1) % num_divisions]
        curves.append(rg.LineCurve(diagonal_1_start, diagonal_1_end))
        
        diagonal_2_start = points[i][(j + 1) % num_divisions]
        diagonal_2_end = points[i + 1][j]
        curves.append(rg.LineCurve(diagonal_2_start, diagonal_2_end))

# Output
a = points  # List of points for reference
b = curves  # Lattice structure as line curves
# ---------- end iteration_4_2 ----------

iteration_4_3 = GhPythonScript()  # -> out, a, b, c, d, e
# ---------- iteration_4_3: Python ----------
import math
import Rhino.Geometry as rg

# Parameters
radius = 10  # Dome radius
num_rings = 20  # Number of concentric rings
num_divisions = 40  # Divisions per ring
height_factor = 2  # Scaling factor for dome height

# Output lists
points = []
radial_lines = []      # Radial connections
circular_lines = []    # Circular connections
diagonal_lines_1 = []  # First diagonal connections (forward slash "/")
diagonal_lines_2 = []  # Second diagonal connections (backslash "\\")

# Generate points on the dome
for i in range(1, num_rings + 1):
    r = radius * (i / num_rings)  # Current ring radius
    ring_points = []
    for j in range(num_divisions):
        angle = 2 * math.pi * (j / num_divisions)
        x = r * math.cos(angle)
        y = r * math.sin(angle)
        z = height_factor * (1 - (r / radius)**2)  # Parabolic height
        ring_points.append(rg.Point3d(x, y, z))
    points.append(ring_points)

# Create connections to form the rhombus pattern
for i in range(len(points) - 1):
    for j in range(num_divisions):
        # Radial connections
        start = points[i][j]
        end = points[i + 1][j]
        radial_lines.append(rg.LineCurve(start, end))
        
        # Circular connections
        next_index = (j + 1) % num_divisions
        start = points[i][j]
        end = points[i][next_index]
        circular_lines.append(rg.LineCurve(start, end))
        
        # Diagonal connections (rhombus pattern)
        diagonal_1_start = points[i][j]
        diagonal_1_end = points[i + 1][(j + 1) % num_divisions]
        diagonal_lines_1.append(rg.LineCurve(diagonal_1_start, diagonal_1_end))
        
        diagonal_2_start = points[i][(j + 1) % num_divisions]
        diagonal_2_end = points[i + 1][j]
        diagonal_lines_2.append(rg.LineCurve(diagonal_2_start, diagonal_2_end))

# Output
a = points  # List of points for reference
b = radial_lines  # Radial connections
c = circular_lines  # Circular connections
d = diagonal_lines_1  # First diagonal (forward slash "/")
e = diagonal_lines_2  # Second diagonal (backslash "\\")
# ---------- end iteration_4_3 ----------
geo_4 = Geometry([iteration_4_3.d, iteration_4_3.e])

pt_4 = Point(Point(43.3100059, 110.409926, 0.4377944869))
iteration_5_6 = GhPythonScript(
    u_count=Slider(100, range=0..100),
    v_count=Slider(100, range=0..100),
    u_step=Slider(1, range=0..10),
    v_step=Slider(1.6, range=0..10),
    amplitude=Slider(4, range=0..10),
    frequency=Slider(0.54, range=0..1),
    attractor=pt_4,
    bump_strength=Slider(36.5, range=0..100),
    falloff=Slider(0.05, range=0..0.1))  # -> out, a; inputs u_count: Int32, v_count: Int32
# ---------- iteration_5_6: Python ----------
import math
import Rhino.Geometry as rg
import scriptcontext as sc

# Inputs from Grasshopper
# u_count: Number of points in the U direction (slider, e.g., 10 to 100)
# v_count: Number of points in the V direction (slider, e.g., 10 to 100)
# u_step: Spacing between points in the U direction (slider, e.g., 1.0 to 10.0)
# v_step: Spacing between points in the V direction (slider, e.g., 1.0 to 10.0)
# amplitude: Amplitude of the sine wave (slider, e.g., 0.1 to 10.0)
# frequency: Frequency of the sine wave (slider, e.g., 0.01 to 1.0)
# attractor: Attractor point (GUID or Point3d from Grasshopper)
# bump_strength: How strong the bump effect is (slider, e.g., 0.1 to 10.0)
# falloff: A multiplier controlling how quickly the bump diminishes with distance (slider, e.g., 0.1 to 2.0)

# Convert attractor GUID to a Point3d if necessary
if isinstance(attractor, rg.Point3d):
    attractor_point = attractor
else:
    # Use Rhino document to fetch geometry from the GUID
    rhino_object = sc.doc.Objects.Find(attractor)
    if rhino_object:
        attractor_point = rhino_object.Geometry.Location
    else:
        raise ValueError("Invalid attractor input. Ensure the attractor is a valid point.")

# Create a grid of points
points = []
for i in range(u_count):
    for j in range(v_count):
        # Calculate the grid point position
        x = i * u_step
        y = j * v_step
        point = rg.Point3d(x, y, 0)
        
        # Calculate the base sine wave Z-coordinate
        z_wave = amplitude * math.sin(frequency * x) * math.sin(frequency * y)
        
        # Calculate the distance to the attractor point
        dist = point.DistanceTo(attractor_point)
        
        # Apply a "bump" based on the attractor's proximity
        bump = bump_strength * math.exp(-falloff * dist)
        
        # Final Z-coordinate combines sine wave and bump
        point.Z = z_wave + bump
        
        # Add the point to the list
        points.append(point)

# Create a mesh from the grid of points
mesh = rg.Mesh()
for i in range(u_count - 1):
    for j in range(v_count - 1):
        # Get the four corner points of the grid cell
        pt1 = points[i * v_count + j]
        pt2 = points[(i + 1) * v_count + j]
        pt3 = points[(i + 1) * v_count + (j + 1)]
        pt4 = points[i * v_count + (j + 1)]

        # Add vertices to the mesh
        mesh.Vertices.Add(pt1)
        mesh.Vertices.Add(pt2)
        mesh.Vertices.Add(pt3)
        mesh.Vertices.Add(pt4)

        # Add faces to the mesh
        v_idx = mesh.Vertices.Count - 4
        mesh.Faces.AddFace(v_idx, v_idx + 1, v_idx + 2, v_idx + 3)

# Output the mesh
a = mesh
# ---------- end iteration_5_6 ----------

pt_5 = Point(Point(1.964695944, 110.409926, 0.4377944869))
iteration_5_4 = GhPythonScript(
    u_count=Slider(100, range=0..100),
    v_count=Slider(100, range=0..100),
    u_step=Slider(0.6, range=0..10),
    v_step=Slider(0.8, range=0..10),
    amplitude=Slider(4.1, range=0..10),
    frequency=Slider(0.31, range=0..1),
    attractor=pt_5,
    falloff=Slider(0.5, range=0..1))  # -> out, a; inputs u_count: Int32, v_count: Int32
# ---------- iteration_5_4: Python ----------
import math
import Rhino.Geometry as rg

# Inputs from Grasshopper
# u_count: Number of points in the U direction (slider, e.g., 10 to 100)
# v_count: Number of points in the V direction (slider, e.g., 10 to 100)
# u_step: Spacing between points in the U direction (slider, e.g., 1.0 to 10.0)
# v_step: Spacing between points in the V direction (slider, e.g., 1.0 to 10.0)
# amplitude: Base amplitude of the sine wave (slider, e.g., 0.1 to 10.0)
# frequency: Frequency of the sine wave (slider, e.g., 0.01 to 1.0)
# attractor: Attractor point (Point3d or GUID from Grasshopper)
# falloff: A multiplier that controls how quickly the attractor effect decreases with distance (slider, e.g., 0.1 to 2.0)

# Ensure the attractor is converted to a Point3d if it is provided as a GUID
if isinstance(attractor, rg.Point3d):
    attractor_point = attractor
else:
    attractor_point = rg.Point3d(attractor.Location)

# Create a grid of points
points = []
for i in range(u_count):
    for j in range(v_count):
        # Calculate the grid point position
        x = i * u_step
        y = j * v_step
        point = rg.Point3d(x, y, 0)
        
        # Calculate the distance to the attractor point
        dist = point.DistanceTo(attractor_point)
        
        # Modify the amplitude based on the attractor's distance (with an exponential falloff)
        local_amplitude = amplitude * math.exp(-falloff * dist)
        
        # Calculate the Z-coordinate using the modified amplitude
        z = local_amplitude * math.sin(frequency * x) * math.sin(frequency * y)
        point.Z = z
        
        # Add the point to the list
        points.append(point)

# Create a mesh from the grid of points
mesh = rg.Mesh()
for i in range(u_count - 1):
    for j in range(v_count - 1):
        # Get the four corner points of the grid cell
        pt1 = points[i * v_count + j]
        pt2 = points[(i + 1) * v_count + j]
        pt3 = points[(i + 1) * v_count + (j + 1)]
        pt4 = points[i * v_count + (j + 1)]

        # Add vertices to the mesh
        mesh.Vertices.Add(pt1)
        mesh.Vertices.Add(pt2)
        mesh.Vertices.Add(pt3)
        mesh.Vertices.Add(pt4)

        # Add faces to the mesh
        v_idx = mesh.Vertices.Count - 4
        mesh.Faces.AddFace(v_idx, v_idx + 1, v_idx + 2, v_idx + 3)

# Output the mesh
a = mesh
# ---------- end iteration_5_4 ----------

pt_6 = Point(Point(1.964695944, 110.409926, 0.4377944869))
iteration_5_3 = GhPythonScript(
    u_count=Slider(100, range=0..100),
    v_count=Slider(100, range=0..100),
    u_step=Slider(0.6, range=0..10),
    v_step=Slider(0.8, range=0..10),
    amplitude=Slider(4.1, range=0..10),
    frequency=Slider(0.31, range=0..1),
    attractor=pt_6,
    falloff=Slider(0.5, range=0..1))  # -> out, a; inputs u_count: Int32, v_count: Int32
# ---------- iteration_5_3: Python ----------
import math
import Rhino.Geometry as rg

# Inputs from Grasshopper
# u_count: Number of points in the U direction (slider, e.g., 10 to 100)
# v_count: Number of points in the V direction (slider, e.g., 10 to 100)
# u_step: Spacing between points in the U direction (slider, e.g., 1.0 to 10.0)
# v_step: Spacing between points in the V direction (slider, e.g., 1.0 to 10.0)
# amplitude: Base amplitude of the sine wave (slider, e.g., 0.1 to 10.0)
# frequency: Frequency of the sine wave (slider, e.g., 0.01 to 1.0)
# attractor: Attractor point (Point3d from Grasshopper)
# falloff: A multiplier that controls how quickly the attractor effect decreases with distance (slider, e.g., 0.1 to 2.0)

# Create a grid of points
points = []
for i in range(u_count):
    for j in range(v_count):
        # Calculate the grid point position
        x = i * u_step
        y = j * v_step
        point = rg.Point3d(x, y, 0)
        
        # Calculate the distance to the attractor point
        dist = point.DistanceTo(attractor)
        
        # Modify the amplitude based on the attractor's distance (with an exponential falloff)
        local_amplitude = amplitude * math.exp(-falloff * dist)
        
        # Calculate the Z-coordinate using the modified amplitude
        z = local_amplitude * math.sin(frequency * x) * math.sin(frequency * y)
        point.Z = z
        
        # Add the point to the list
        points.append(point)

# Create a mesh from the grid of points
mesh = rg.Mesh()
for i in range(u_count - 1):
    for j in range(v_count - 1):
        # Get the four corner points of the grid cell
        pt1 = points[i * v_count + j]
        pt2 = points[(i + 1) * v_count + j]
        pt3 = points[(i + 1) * v_count + (j + 1)]
        pt4 = points[i * v_count + (j + 1)]

        # Add vertices to the mesh
        mesh.Vertices.Add(pt1)
        mesh.Vertices.Add(pt2)
        mesh.Vertices.Add(pt3)
        mesh.Vertices.Add(pt4)

        # Add faces to the mesh
        v_idx = mesh.Vertices.Count - 4
        mesh.Faces.AddFace(v_idx, v_idx + 1, v_idx + 2, v_idx + 3)

# Output the mesh
a = mesh
# ---------- end iteration_5_3 ----------

# ----
# Case Study 5:  Deformed Sine Wave Surface (p. 247)
number_slider_3 = Slider(100, range=0..100)
iteration_5_2 = GhPythonScript(
    u_count=number_slider_3,
    v_count=Slider(100, range=0..100),
    u_step=Slider(0.6, range=0..10),
    v_step=Slider(0.8, range=0..10),
    amplitude=Slider(4.1, range=0..10),
    frequency=Slider(0.31, range=0..1))  # -> out, a; inputs u_count: Int32, v_count: Int32
# ---------- iteration_5_2: Python ----------
import math
import Rhino.Geometry as rg

# Inputs from Grasshopper
# u_count: Number of points in the U direction (slider, e.g., 10 to 100)
# v_count: Number of points in the V direction (slider, e.g., 10 to 100)
# u_step: Spacing between points in the U direction (slider, e.g., 1.0 to 10.0)
# v_step: Spacing between points in the V direction (slider, e.g., 1.0 to 10.0)
# amplitude: Amplitude of the sine wave (slider, e.g., 0.1 to 10.0)
# frequency: Frequency of the sine wave (slider, e.g., 0.01 to 1.0)

# Create a grid of points
points = []
for i in range(u_count):
    for j in range(v_count):
        x = i * u_step
        y = j * v_step
        z = amplitude * math.sin(frequency * x) * math.sin(frequency * y)
        point = rg.Point3d(x, y, z)
        points.append(point)

# Create a mesh from the grid of points
mesh = rg.Mesh()
for i in range(u_count - 1):
    for j in range(v_count - 1):
        # Get the four corner points of the grid cell
        pt1 = points[i * v_count + j]
        pt2 = points[(i + 1) * v_count + j]
        pt3 = points[(i + 1) * v_count + (j + 1)]
        pt4 = points[i * v_count + (j + 1)]

        # Add vertices to the mesh
        mesh.Vertices.Add(pt1)
        mesh.Vertices.Add(pt2)
        mesh.Vertices.Add(pt3)
        mesh.Vertices.Add(pt4)

        # Add faces to the mesh
        v_idx = mesh.Vertices.Count - 4
        mesh.Faces.AddFace(v_idx, v_idx + 1, v_idx + 2, v_idx + 3)

# Output the mesh
a = mesh
# ---------- end iteration_5_2 ----------

pt_7 = Point(Point(1.964695944, 110.409926, 0.4377944869))
iteration_5_5 = GhPythonScript(
    u_count=Slider(100, range=0..100),
    v_count=Slider(100, range=0..100),
    u_step=Slider(0.6, range=0..10),
    v_step=Slider(0.8, range=0..10),
    amplitude=Slider(8.6, range=0..10),
    frequency=Slider(0.31, range=0..1),
    attractor=pt_7,
    falloff=Slider(0.04, range=0..0.1))  # -> out, a; inputs u_count: Int32, v_count: Int32
# ---------- iteration_5_5: Python ----------
import math
import Rhino.Geometry as rg
import scriptcontext as sc

# Inputs from Grasshopper
# u_count: Number of points in the U direction (slider, e.g., 10 to 100)
# v_count: Number of points in the V direction (slider, e.g., 10 to 100)
# u_step: Spacing between points in the U direction (slider, e.g., 1.0 to 10.0)
# v_step: Spacing between points in the V direction (slider, e.g., 1.0 to 10.0)
# amplitude: Base amplitude of the sine wave (slider, e.g., 0.1 to 10.0)
# frequency: Frequency of the sine wave (slider, e.g., 0.01 to 1.0)
# attractor: Attractor point (GUID or Point3d from Grasshopper)
# falloff: A multiplier that controls how quickly the attractor effect decreases with distance (slider, e.g., 0.1 to 2.0)

# Convert attractor GUID to a Point3d if necessary
if isinstance(attractor, rg.Point3d):
    attractor_point = attractor
else:
    # Use Rhino document to fetch geometry from the GUID
    rhino_object = sc.doc.Objects.Find(attractor)
    if rhino_object:
        attractor_point = rhino_object.Geometry.Location
    else:
        raise ValueError("Invalid attractor input. Ensure the attractor is a valid point.")

# Create a grid of points
points = []
for i in range(u_count):
    for j in range(v_count):
        # Calculate the grid point position
        x = i * u_step
        y = j * v_step
        point = rg.Point3d(x, y, 0)
        
        # Calculate the distance to the attractor point
        dist = point.DistanceTo(attractor_point)
        
        # Modify the amplitude based on the attractor's distance (with an exponential falloff)
        local_amplitude = amplitude * math.exp(-falloff * dist)
        
        # Calculate the Z-coordinate using the modified amplitude
        z = local_amplitude * math.sin(frequency * x) * math.sin(frequency * y)
        point.Z = z
        
        # Add the point to the list
        points.append(point)

# Create a mesh from the grid of points
mesh = rg.Mesh()
for i in range(u_count - 1):
    for j in range(v_count - 1):
        # Get the four corner points of the grid cell
        pt1 = points[i * v_count + j]
        pt2 = points[(i + 1) * v_count + j]
        pt3 = points[(i + 1) * v_count + (j + 1)]
        pt4 = points[i * v_count + (j + 1)]

        # Add vertices to the mesh
        mesh.Vertices.Add(pt1)
        mesh.Vertices.Add(pt2)
        mesh.Vertices.Add(pt3)
        mesh.Vertices.Add(pt4)

        # Add faces to the mesh
        v_idx = mesh.Vertices.Count - 4
        mesh.Faces.AddFace(v_idx, v_idx + 1, v_idx + 2, v_idx + 3)

# Output the mesh
a = mesh
# ---------- end iteration_5_5 ----------

iteration_5_1 = GhPythonScript()  # -> out, a
# ---------- iteration_5_1: Python ----------
import math
import Rhino.Geometry as rg

# Input parameters
u_count = 50  # Number of points in the U direction
v_count = 50  # Number of points in the V direction
u_step = 2  # Spacing between points in the U direction
v_step = 2  # Spacing between points in the V direction
amplitude = 5  # Amplitude of the sine wave
frequency = 0.2  # Frequency of the sine wave

# Create a grid of points
points = []
for i in range(u_count):
    for j in range(v_count):
        x = i * u_step
        y = j * v_step
        z = amplitude * math.sin(frequency * x) * math.sin(frequency * y)
        point = rg.Point3d(x, y, z)
        points.append(point)

# Create a mesh from the grid of points
mesh = rg.Mesh()
for i in range(u_count - 1):
    for j in range(v_count - 1):
        # Get the four corner points of the grid cell
        pt1 = points[i * v_count + j]
        pt2 = points[(i + 1) * v_count + j]
        pt3 = points[(i + 1) * v_count + (j + 1)]
        pt4 = points[i * v_count + (j + 1)]

        # Add vertices to the mesh
        mesh.Vertices.Add(pt1)
        mesh.Vertices.Add(pt2)
        mesh.Vertices.Add(pt3)
        mesh.Vertices.Add(pt4)

        # Add faces to the mesh
        v_idx = mesh.Vertices.Count - 4
        mesh.Faces.AddFace(v_idx, v_idx + 1, v_idx + 2, v_idx + 3)

# Output the mesh
a = mesh
# ---------- end iteration_5_1 ----------

crv_6 = Curve(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)
iteration_6_8 = GhPythonScript(
    x=crv_6,
    height=Slider(9, range=0..100),
    num_curves=Slider(58, range=0..100),
    total_twist=Slider(106, range=0..360),
    scale_factor=Slider(0.988, range=0.95..1.05))  # -> out, a; inputs num_curves: Int32
# ---------- iteration_6_8: Python ----------
import Rhino.Geometry as rg
import math
import scriptcontext as sc

# Inputs
profile_curve = sc.doc.Objects.Find(x).Geometry  # Convert Guid to Rhino.Geometry curve
# height = 20             # Total height of the object
# num_curves = 30         # Number of horizontal copies
# total_twist = 180       # Total rotation in degrees along the height
# scale_factor = 0.9      # Scaling factor for each level (e.g., 0.9 for decreasing size, >1 for increasing)

# Calculate the center of the area of the first profile curve
area_centroid = rg.AreaMassProperties.Compute(profile_curve).Centroid

# Initialize empty list for surfaces
surfaces = []

for i in range(num_curves):
    # Calculate the z-height of the current level
    z = (i / (num_curves - 1)) * height
    
    # Copy the user-defined curve
    transformed_curve = profile_curve.Duplicate()
    
    # Apply scaling transformation
    scaling_factor = scale_factor ** i  # Scale exponentially for each level
    scale_transform = rg.Transform.Scale(area_centroid, scaling_factor)
    transformed_curve.Transform(scale_transform)
    
    # Rotate the curve incrementally around the center of the first level
    rotation = math.radians((i / (num_curves - 1)) * total_twist)  # Convert degrees to radians
    rotation_transform = rg.Transform.Rotation(rotation, rg.Vector3d.ZAxis, area_centroid)
    transformed_curve.Transform(rotation_transform)
    
    # Move the curve to its correct height
    translation_transform = rg.Transform.Translation(0, 0, z)
    transformed_curve.Transform(translation_transform)
    
    # Create a planar surface from the transformed curve
    planar_surface = rg.Brep.CreatePlanarBreps(transformed_curve)
    if planar_surface:
        surfaces.append(planar_surface[0])  # Add the planar surface to the list

# Output the resulting horizontal surfaces
a = surfaces
# ---------- end iteration_6_8 ----------

crv_7 = Curve(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)
iteration_6_7 = GhPythonScript(x=crv_7, height=Slider(9, range=0..100), num_curves=Slider(58, range=0..100), total_twist=Slider(136, range=0..360))  # -> out, a; inputs num_curves: Int32
# ---------- iteration_6_7: Python ----------
import Rhino.Geometry as rg
import math
import scriptcontext as sc

# Inputs
profile_curve = sc.doc.Objects.Find(x).Geometry  # Convert Guid to Rhino.Geometry curve
#height = 20             # Total height of the object
#num_curves = 30         # Number of horizontal copies
#total_twist = 180       # Total rotation in degrees along the height

# Calculate the center of the area of the first profile curve
area_centroid = rg.AreaMassProperties.Compute(profile_curve).Centroid

# Initialize empty list for surfaces
surfaces = []

for i in range(num_curves):
    # Calculate the z-height of the current level
    z = (i / (num_curves - 1)) * height
    
    # Copy the user-defined curve
    transformed_curve = profile_curve.Duplicate()
    
    # Rotate the curve incrementally around the center of the first level
    rotation = math.radians((i / (num_curves - 1)) * total_twist)  # Convert degrees to radians
    rotation_transform = rg.Transform.Rotation(rotation, rg.Vector3d.ZAxis, area_centroid)
    transformed_curve.Transform(rotation_transform)
    
    # Move the curve to its correct height
    translation_transform = rg.Transform.Translation(0, 0, z)
    transformed_curve.Transform(translation_transform)
    
    # Create a planar surface from the transformed curve
    planar_surface = rg.Brep.CreatePlanarBreps(transformed_curve)
    if planar_surface:
        surfaces.append(planar_surface[0])  # Add the planar surface to the list

# Output the resulting horizontal surfaces
a = surfaces
# ---------- end iteration_6_7 ----------

crv_8 = Curve(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)
iteration_6_6 = GhPythonScript(x=crv_8)  # -> out, a
# ---------- iteration_6_6: Python ----------
import Rhino.Geometry as rg
import math
import scriptcontext as sc

# Inputs
profile_curve = sc.doc.Objects.Find(x).Geometry  # Convert Guid to Rhino.Geometry curve
height = 20             # Total height of the object
num_curves = 30         # Number of horizontal copies
total_twist = 180       # Total rotation in degrees along the height

# Calculate the center of the area of the first profile curve
area_centroid = rg.AreaMassProperties.Compute(profile_curve).Centroid

# Initialize empty list for surfaces
surfaces = []

for i in range(num_curves):
    # Calculate the z-height of the current level
    z = (i / (num_curves - 1)) * height
    
    # Copy the user-defined curve
    transformed_curve = profile_curve.Duplicate()
    
    # Rotate the curve incrementally around the center of the first level
    rotation = math.radians((i / (num_curves - 1)) * total_twist)  # Convert degrees to radians
    rotation_transform = rg.Transform.Rotation(rotation, rg.Vector3d.ZAxis, area_centroid)
    transformed_curve.Transform(rotation_transform)
    
    # Move the curve to its correct height
    translation_transform = rg.Transform.Translation(0, 0, z)
    transformed_curve.Transform(translation_transform)
    
    # Create a planar surface from the transformed curve
    planar_surface = rg.Brep.CreatePlanarBreps(transformed_curve)
    if planar_surface:
        surfaces.append(planar_surface[0])  # Add the planar surface to the list

# Output the resulting horizontal surfaces
a = surfaces
# ---------- end iteration_6_6 ----------

crv_9 = Curve(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)
iteration_6_5 = GhPythonScript(x=crv_9)  # -> out, a
# ---------- iteration_6_5: Python ----------
import Rhino.Geometry as rg
import math
import scriptcontext as sc

# Inputs
profile_curve = sc.doc.Objects.Find(x).Geometry  # Convert Guid to Rhino.Geometry curve
height = 10             # Total height of the object
num_curves = 30         # Number of horizontal copies
total_twist = 180       # Total rotation in degrees along the height

# Calculate the center of the area of the first profile curve
area_centroid = rg.AreaMassProperties.Compute(profile_curve).Centroid

# Initialize empty list for transformed curves
curves = []

for i in range(num_curves):
    # Calculate the z-height of the current curve
    z = (i / (num_curves - 1)) * height
    
    # Copy the user-defined curve
    transformed_curve = profile_curve.Duplicate()
    
    # Rotate the curve incrementally around the center of the first level
    rotation = math.radians((i / (num_curves - 1)) * total_twist)  # Convert degrees to radians
    rotation_transform = rg.Transform.Rotation(rotation, rg.Vector3d.ZAxis, area_centroid)
    transformed_curve.Transform(rotation_transform)
    
    # Move the curve to its correct height
    translation_transform = rg.Transform.Translation(0, 0, z)
    transformed_curve.Transform(translation_transform)
    
    # Add the transformed curve to the list
    curves.append(transformed_curve)

# Loft the curves to create a single continuous surface
loft_result = rg.Brep.CreateFromLoft(curves, rg.Point3d.Unset, rg.Point3d.Unset, rg.LoftType.Normal, False)

# Ensure the result is a single continuous surface
if loft_result:
    loft_surface = loft_result[0]  # Use the first (and only) Brep in the result
else:
    loft_surface = None

# Output the resulting geometry
a = loft_surface
# ---------- end iteration_6_5 ----------

crv_10 = Curve(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)
iteration_6_3 = GhPythonScript(x=crv_10)  # -> out, a
# ---------- iteration_6_3: Python ----------
import Rhino.Geometry as rg
import math
import scriptcontext as sc

# Inputs
profile_curve = sc.doc.Objects.Find(x).Geometry  # Convert Guid to Rhino.Geometry curve
height = 10             # Total height of the object
num_curves = 30         # Number of horizontal copies
total_twist = 180       # Total rotation in degrees along the height

# Initialize empty list for transformed curves
curves = []

for i in range(num_curves):
    # Calculate the z-height of the current curve
    z = (i / (num_curves - 1)) * height
    
    # Copy the user-defined curve
    transformed_curve = profile_curve.Duplicate()  # Duplicate the original curve
    
    # Rotate the curve incrementally around the Z-axis
    rotation = math.radians((i / (num_curves - 1)) * total_twist)  # Convert degrees to radians
    rotation_transform = rg.Transform.Rotation(rotation, rg.Vector3d.ZAxis, rg.Point3d.Origin)
    transformed_curve.Transform(rotation_transform)
    
    # Move the curve to its correct height
    translation_transform = rg.Transform.Translation(0, 0, z)
    transformed_curve.Transform(translation_transform)
    
    # Add the transformed curve to the list
    curves.append(transformed_curve)

# Loft the transformed curves to create a surface
loft_result = rg.Brep.CreateFromLoft(curves, rg.Point3d.Unset, rg.Point3d.Unset, rg.LoftType.Normal, False)

# Output the resulting geometry
a = loft_result
# ---------- end iteration_6_3 ----------

crv_11 = Curve(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)
iteration_6_2 = GhPythonScript(x=crv_11)  # -> out, a
# ---------- iteration_6_2: Python ----------
import Rhino.Geometry as rg
import math

# Inputs
profile_curve = x       # User-defined profile curve (input as Curve in Grasshopper)
height = 10             # Total height of the object
num_curves = 30         # Number of horizontal copies
total_twist = 180       # Total rotation in degrees along the height

# Initialize empty list for transformed curves
curves = []

for i in range(num_curves):
    # Calculate the z-height of the current curve
    z = (i / (num_curves - 1)) * height
    
    # Copy the user-defined curve
    transformed_curve = profile_curve.Duplicate()
    
    # Rotate the curve incrementally around the Z-axis
    rotation = math.radians((i / (num_curves - 1)) * total_twist)  # Convert degrees to radians
    rotation_transform = rg.Transform.Rotation(rotation, rg.Vector3d.ZAxis, rg.Point3d.Origin)
    transformed_curve.Transform(rotation_transform)
    
    # Move the curve to its correct height
    translation_transform = rg.Transform.Translation(0, 0, z)
    transformed_curve.Transform(translation_transform)
    
    # Add the transformed curve to the list
    curves.append(transformed_curve)

# Loft the transformed curves to create a surface
loft_result = rg.Brep.CreateFromLoft(curves, rg.Point3d.Unset, rg.Point3d.Unset, rg.LoftType.Normal, False)

# Output the resulting geometry
a = loft_result
# ---------- end iteration_6_2 ----------

crv_12 = Curve(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)
iteration_6_4 = GhPythonScript(x=crv_12)  # -> out, a
# ---------- iteration_6_4: Python ----------
import Rhino.Geometry as rg
import math
import scriptcontext as sc

# Inputs
profile_curve = sc.doc.Objects.Find(x).Geometry  # Convert Guid to Rhino.Geometry curve
height = 10             # Total height of the object
num_curves = 30         # Number of horizontal copies
total_twist = 180       # Total rotation in degrees along the height

# Calculate the center of the area of the first profile curve
area_centroid = rg.AreaMassProperties.Compute(profile_curve).Centroid

# Initialize empty list for transformed curves
curves = []

for i in range(num_curves):
    # Calculate the z-height of the current curve
    z = (i / (num_curves - 1)) * height
    
    # Copy the user-defined curve
    transformed_curve = profile_curve.Duplicate()
    
    # Rotate the curve incrementally around the center of the first level
    rotation = math.radians((i / (num_curves - 1)) * total_twist)  # Convert degrees to radians
    rotation_transform = rg.Transform.Rotation(rotation, rg.Vector3d.ZAxis, area_centroid)
    transformed_curve.Transform(rotation_transform)
    
    # Move the curve to its correct height
    translation_transform = rg.Transform.Translation(0, 0, z)
    transformed_curve.Transform(translation_transform)
    
    # Add the transformed curve to the list
    curves.append(transformed_curve)

# Loft the transformed curves to create a surface
loft_result = rg.Brep.CreateFromLoft(curves, rg.Point3d.Unset, rg.Point3d.Unset, rg.LoftType.Normal, False)

# Output the resulting geometry
a = loft_result
# ---------- end iteration_6_4 ----------

# ----
# Case Study 6:  Twisted Tower (p.202)
iteration_6_1 = GhPythonScript()  # -> out, a
# ---------- iteration_6_1: Python ----------
import Rhino.Geometry as rg
import math

# Inputs
base_radius = 2       # Base radius of the shape
top_radius = 1        # Top radius of the shape
height = 10           # Total height of the object
num_curves = 30       # Number of horizontal curves
total_twist = 180     # Total rotation in degrees along the height

# Initialize empty list for the curves
curves = []

for i in range(num_curves):
    # Calculate the z-height of the current curve
    z = (i / (num_curves - 1)) * height
    
    # Interpolate the radius
    radius = base_radius + (top_radius - base_radius) * (i / (num_curves - 1))
    
    # Create a base circle at the origin
    circle = rg.Circle(rg.Plane.WorldXY, radius)
    
    # Rotate the circle incrementally around the Z-axis
    rotation = math.radians((i / (num_curves - 1)) * total_twist)  # Convert degrees to radians
    transformation = rg.Transform.Rotation(rotation, rg.Vector3d.ZAxis, rg.Point3d(0, 0, z))
    circle.Transform(transformation)
    
    # Move the circle to its correct height
    translation = rg.Transform.Translation(0, 0, z)
    circle.Transform(translation)
    
    # Add the transformed circle to the list of curves
    curves.append(circle.ToNurbsCurve())

# Loft the curves to create a surface
loft_result = rg.Brep.CreateFromLoft(curves, rg.Point3d.Unset, rg.Point3d.Unset, rg.LoftType.Normal, False)

# Output the resulting geometry
a = loft_result
# ---------- end iteration_6_1 ----------

iteration_7_12 = GhPythonScript(
    grid_width=Slider(10, range=0..10),
    grid_height=Slider(20, range=0..100),
    step_size=Slider(15, range=0..100),
    pyramid_height=Slider(1.32, range=0..5))  # -> out, a
# ---------- iteration_7_12: Python ----------
import Rhino.Geometry as rg

def create_triangular_grid(grid_width, grid_height, step_size):
    """Create a triangular grid of points."""
    points = []
    for i in range(int(grid_height / step_size) + 1):
        row = []
        for j in range(int(grid_width / step_size) + 1):
            x = j * step_size
            y = i * step_size * 0.866  # Multiply by sin(60°) to create equilateral triangles
            if i % 2 == 1:  # Offset alternate rows
                x += step_size / 2
            row.append(rg.Point3d(x, y, 0))
        points.append(row)
    return points

def create_triangles_from_grid(points):
    """Create triangles from a triangular grid of points."""
    triangles = []
    for i in range(len(points) - 1):
        for j in range(len(points[i]) - 1):
            # Create two triangles per square
            p1 = points[i][j]
            p2 = points[i][j + 1]
            p3 = points[i + 1][j]
            p4 = points[i + 1][j + 1]
            
            if i % 2 == j % 2:  # Flip the diagonal for staggered rows
                triangles.append([p1, p3, p2])
                triangles.append([p3, p4, p2])
            else:
                triangles.append([p1, p4, p2])
                triangles.append([p1, p3, p4])
    return triangles

def create_pyramids_from_triangles(triangles, height):
    """Create pyramids for each triangle."""
    pyramids = []
    for triangle in triangles:
        # Compute the apex of the pyramid
        apex = rg.Point3d(
            (triangle[0].X + triangle[1].X + triangle[2].X) / 3,
            (triangle[0].Y + triangle[1].Y + triangle[2].Y) / 3,
            height
        )
        # Create triangular faces as surfaces
        for i in range(3):
            p1 = triangle[i]
            p2 = triangle[(i + 1) % 3]  # Wrap around to the first vertex
            pyramids.append(rg.Brep.CreateFromCornerPoints(p1, p2, apex, 0.001))
    return pyramids

# Inputs from Grasshopper sliders
# grid_width: Width of the grid (slider input)
# grid_height: Height of the grid (slider input)
# step_size: Distance between points in the grid (slider input)
# pyramid_height: Height of the pyramid apex above each triangle (slider input)

try:
    # Step 1: Create triangular grid of points
    grid_points = create_triangular_grid(grid_width, grid_height, step_size)
    
    # Step 2: Create triangles from the grid points
    triangles = create_triangles_from_grid(grid_points)
    
    # Step 3: Create pyramids from the triangles
    pyramid_surfaces = create_pyramids_from_triangles(triangles, pyramid_height)
    
    # Output the pyramid surfaces
    a = pyramid_surfaces
except Exception as e:
    # Debugging: Output the error message
    a = "Error: {}".format(str(e))
# ---------- end iteration_7_12 ----------

iteration_7_17 = GhPythonScript(
    grid_width=Slider(21, range=0..50),
    grid_height=Slider(37, range=0..100),
    step_size=Slider(4, range=0..5),
    pyramid_height=Slider(0.55, range=0..5))  # -> out, a
# ---------- iteration_7_17: Python ----------
import Rhino.Geometry as rg

def create_triangular_grid(grid_width, grid_height, step_size):
    """Create a triangular grid of points."""
    points = []
    for i in range(int(grid_height / step_size) + 1):
        row = []
        for j in range(int(grid_width / step_size) + 1):
            x = j * step_size
            y = i * step_size * 0.866  # Multiply by sin(60°) to create equilateral triangles
            if i % 2 == 1:  # Offset alternate rows
                x += step_size / 2
            row.append(rg.Point3d(x, y, 0))
        points.append(row)
    return points

def create_triangles_from_grid(points):
    """Create triangles from a triangular grid of points."""
    triangles = []
    for i in range(len(points) - 1):
        for j in range(len(points[i]) - 1):
            # Create two triangles per square
            p1 = points[i][j]
            p2 = points[i][j + 1]
            p3 = points[i + 1][j]
            p4 = points[i + 1][j + 1]
            
            if i % 2 == j % 2:  # Flip the diagonal for staggered rows
                triangles.append([p1, p3, p2])
                triangles.append([p3, p4, p2])
            else:
                triangles.append([p1, p4, p2])
                triangles.append([p1, p3, p4])
    return triangles

def create_pyramids_from_triangles(triangles, height):
    """Create pyramids for each triangle."""
    pyramids = []
    for triangle in triangles:
        # Compute the apex of the pyramid
        apex = rg.Point3d(
            (triangle[0].X + triangle[1].X + triangle[2].X) / 3,
            (triangle[0].Y + triangle[1].Y + triangle[2].Y) / 3,
            height
        )
        # Create triangular faces as surfaces
        for i in range(3):
            p1 = triangle[i]
            p2 = triangle[(i + 1) % 3]  # Wrap around to the first vertex
            pyramids.append(rg.Brep.CreateFromCornerPoints(p1, p2, apex, 0.001))
    return pyramids

# Parameters
#grid_width = 10.0  # Width of the triangular grid
#grid_height = 10.0  # Height of the triangular grid
#step_size = 1.0  # Size of each triangle's side
#pyramid_height = 1.0  # Height of each pyramid

try:
    # Step 1: Create triangular grid of points
    grid_points = create_triangular_grid(grid_width, grid_height, step_size)
    
    # Step 2: Create triangles from the grid points
    triangles = create_triangles_from_grid(grid_points)
    
    # Step 3: Create pyramids from the triangles
    pyramid_surfaces = create_pyramids_from_triangles(triangles, pyramid_height)
    
    # Output the pyramid surfaces
    a = pyramid_surfaces
except Exception as e:
    # Debugging: Output the error message
    a = "Error: {}".format(str(e))
# ---------- end iteration_7_17 ----------

# ----
# Case Study 7:  Triangular Grid with Pyramid Tessellation  (p.269)
iteration_7_1 = GhPythonScript()  # -> out, a
# ---------- iteration_7_1: Python ----------
import Rhino.Geometry as rg

def create_flat_surface(width, height):
    """Create a flat rectangular surface."""
    # Create a rectangle in the XY plane
    corner1 = rg.Point3d(0, 0, 0)
    corner2 = rg.Point3d(width, height, 0)
    rectangle = rg.Rectangle3d(rg.Plane.WorldXY, corner1, corner2)
    return rg.NurbsSurface.CreateFromCorners(
        rectangle.Corner(0), 
        rectangle.Corner(1), 
        rectangle.Corner(2), 
        rectangle.Corner(3)
    )

def generate_tessellated_surface(base_surface, u_divisions, v_divisions):
    """Generate tessellated geometry with triangular panels."""
    if not isinstance(base_surface, rg.Surface):
        raise TypeError("Input must be a Rhino Surface.")
    
    points = []
    u_step = 1.0 / u_divisions
    v_step = 1.0 / v_divisions

    # Generate grid points
    for i in range(u_divisions + 1):
        for j in range(v_divisions + 1):
            u = base_surface.Domain(0).ParameterAt(i * u_step)
            v = base_surface.Domain(1).ParameterAt(j * v_step)
            points.append(base_surface.PointAt(u, v))
    
    # Create panels using triangular faces
    triangles = []
    for i in range(u_divisions):
        for j in range(v_divisions):
            p1 = points[i * (v_divisions + 1) + j]
            p2 = points[i * (v_divisions + 1) + (j + 1)]
            p3 = points[(i + 1) * (v_divisions + 1) + j]
            p4 = points[(i + 1) * (v_divisions + 1) + (j + 1)]
            
            # Define two triangles per quad
            triangles.append(rg.Polyline([p1, p2, p3, p1]).ToNurbsCurve())
            triangles.append(rg.Polyline([p3, p2, p4, p3]).ToNurbsCurve())
    
    return triangles

# Flat surface dimensions
width = 10.0  # Width of the rectangle
height = 10.0  # Height of the rectangle
u_divisions = 5  # Number of divisions in the U direction
v_divisions = 5  # Number of divisions in the V direction

try:
    # Create a flat rectangular surface
    flat_surface = create_flat_surface(width, height)
    
    # Generate tessellated geometry
    tessellated_triangles = generate_tessellated_surface(flat_surface, u_divisions, v_divisions)
    
    # Output tessellated geometry
    a = tessellated_triangles
except Exception as e:
    # Debugging: Output the error message to help resolve issues
    a = "Error: {}".format(str(e))
# ---------- end iteration_7_1 ----------
iteration_7_2 = GhPythonScript()  # -> out, a
# ---------- iteration_7_2: Python ----------
import Rhino.Geometry as rg

def create_flat_surface(width, height, u_divisions, v_divisions):
    """Create a flat rectangular surface and return its grid points."""
    points = []
    u_step = width / u_divisions
    v_step = height / v_divisions

    # Generate grid points
    for i in range(u_divisions + 1):
        row = []
        for j in range(v_divisions + 1):
            x = i * u_step
            y = j * v_step
            z = 0  # Start flat
            row.append(rg.Point3d(x, y, z))
        points.append(row)
    return points

def fold_geometry(points, height_factor):
    """Apply folding pattern by altering the Z-coordinates of grid points."""
    for i in range(len(points)):
        for j in range(len(points[i])):
            # Apply a folding effect: alternate heights
            if (i + j) % 2 == 0:
                points[i][j].Z += height_factor
            else:
                points[i][j].Z -= height_factor
    return points

def create_tessellation(points):
    """Create triangular tessellation based on folded grid points."""
    triangles = []
    for i in range(len(points) - 1):
        for j in range(len(points[i]) - 1):
            # Define two triangles per quad
            p1 = points[i][j]
            p2 = points[i][j + 1]
            p3 = points[i + 1][j]
            p4 = points[i + 1][j + 1]

            # First triangle
            triangles.append(rg.Polyline([p1, p2, p3, p1]).ToNurbsCurve())
            # Second triangle
            triangles.append(rg.Polyline([p3, p2, p4, p3]).ToNurbsCurve())
    return triangles

# Parameters
width = 10.0  # Width of the surface
height = 10.0  # Height of the surface
u_divisions = 5  # Number of divisions in the U direction
v_divisions = 5  # Number of divisions in the V direction
height_factor = 1.0  # Folding height factor

try:
    # Step 1: Create flat surface grid
    flat_points = create_flat_surface(width, height, u_divisions, v_divisions)
    
    # Step 2: Apply folding to grid points
    folded_points = fold_geometry(flat_points, height_factor)
    
    # Step 3: Create tessellation geometry
    tessellation = create_tessellation(folded_points)
    
    # Output tessellated geometry
    a = tessellation
except Exception as e:
    # Debugging: Output the error message
    a = "Error: {}".format(str(e))
# ---------- end iteration_7_2 ----------
iteration_7_3 = GhPythonScript()  # -> out, a
# ---------- iteration_7_3: Python ----------
import Rhino.Geometry as rg

def create_flat_surface(width, height, u_divisions, v_divisions):
    """Create a flat rectangular surface and return its grid points."""
    points = []
    u_step = width / u_divisions
    v_step = height / v_divisions

    # Generate grid points
    for i in range(u_divisions + 1):
        row = []
        for j in range(v_divisions + 1):
            x = i * u_step
            y = j * v_step
            z = 0  # Start flat
            row.append(rg.Point3d(x, y, z))
        points.append(row)
    return points

def create_folding_effect(points, fold_height):
    """Apply folding effect to create 3D faceted geometry."""
    for i in range(len(points)):
        for j in range(len(points[i])):
            # Adjust Z-coordinate to create the folding effect
            if (i + j) % 2 == 0:
                points[i][j].Z = fold_height  # Peak
            else:
                points[i][j].Z = -fold_height  # Valley
    return points

def create_diamond_tessellation(points):
    """Create diamond-shaped tessellation based on folded grid points."""
    diamonds = []
    for i in range(len(points) - 1):
        for j in range(len(points[i]) - 1):
            # Create a diamond shape from four points
            p1 = points[i][j]
            p2 = points[i][j + 1]
            p3 = points[i + 1][j]
            p4 = points[i + 1][j + 1]
            
            # Define the diamond using two triangles
            diamonds.append(rg.Polyline([p1, p2, p4, p3, p1]).ToNurbsCurve())
    return diamonds

# Parameters
width = 10.0  # Width of the surface
height = 10.0  # Height of the surface
u_divisions = 5  # Number of divisions in the U direction
v_divisions = 5  # Number of divisions in the V direction
fold_height = 1.0  # Height of the fold (Z-displacement)

try:
    # Step 1: Create flat rectangular grid
    flat_points = create_flat_surface(width, height, u_divisions, v_divisions)
    
    # Step 2: Apply folding effect
    folded_points = create_folding_effect(flat_points, fold_height)
    
    # Step 3: Create diamond tessellation geometry
    diamond_tessellation = create_diamond_tessellation(folded_points)
    
    # Output the tessellation geometry
    a = diamond_tessellation
except Exception as e:
    # Debugging: Output the error message
    a = "Error: {}".format(str(e))
# ---------- end iteration_7_3 ----------
iteration_7_4 = GhPythonScript()  # -> out, a
# ---------- iteration_7_4: Python ----------
import Rhino.Geometry as rg
import math

def create_triangular_grid(width, height, u_divisions, v_divisions):
    """Create a triangular grid of points."""
    points = []
    x_step = width / u_divisions
    y_step = height / v_divisions

    for i in range(v_divisions + 1):
        for j in range(u_divisions + 1):
            x = j * x_step
            y = i * y_step

            # Shift every alternate row
            if i % 2 == 1:
                x += x_step / 2

            points.append(rg.Point3d(x, y, 0))

    return points

def create_pyramids(points, u_divisions, v_divisions, height):
    """Create pyramids on top of each triangular cell."""
    pyramids = []
    rows = v_divisions + 1

    for i in range(v_divisions):
        for j in range(u_divisions):
            # Get vertices of the triangle
            if i % 2 == 0:
                p1 = points[i * rows + j]
                p2 = points[i * rows + j + 1]
                p3 = points[(i + 1) * rows + j]
            else:
                p1 = points[i * rows + j + 1]
                p2 = points[(i + 1) * rows + j + 1]
                p3 = points[(i + 1) * rows + j]

            # Compute the pyramid apex
            center = rg.Point3d(
                (p1.X + p2.X + p3.X) / 3,
                (p1.Y + p2.Y + p3.Y) / 3,
                height
            )

            # Create triangular faces of the pyramid
            pyramids.append(rg.Polyline([p1, p2, center, p1]).ToNurbsCurve())
            pyramids.append(rg.Polyline([p2, p3, center, p2]).ToNurbsCurve())
            pyramids.append(rg.Polyline([p3, p1, center, p3]).ToNurbsCurve())

    return pyramids

# Parameters
width = 10.0  # Width of the grid
height = 10.0  # Height of the grid
u_divisions = 5  # Number of divisions in the U direction
v_divisions = 5  # Number of divisions in the V direction
pyramid_height = 1.0  # Height of the pyramid

try:
    # Step 1: Create triangular grid
    grid_points = create_triangular_grid(width, height, u_divisions, v_divisions)
    
    # Step 2: Create pyramids on each triangular cell
    pyramid_geometry = create_pyramids(grid_points, u_divisions, v_divisions, pyramid_height)
    
    # Output the pyramids
    a = pyramid_geometry
except Exception as e:
    # Debugging: Output the error message
    a = "Error: {}".format(str(e))
# ---------- end iteration_7_4 ----------
iteration_7_5 = GhPythonScript()  # -> out, a
# ---------- iteration_7_5: Python ----------
import Rhino.Geometry as rg
import math

def create_hexagonal_grid(radius, rows, cols):
    """Create a hexagonal grid of points."""
    points = []
    height = math.sqrt(3) * radius  # Height of the hexagon

    for i in range(rows):
        for j in range(cols):
            # Calculate the position of each hexagon center
            x = j * 1.5 * radius
            y = i * height
            if j % 2 == 1:  # Shift alternate columns
                y += height / 2
            points.append(rg.Point3d(x, y, 0))

    return points

def create_hexagon(center, radius):
    """Create a hexagon given a center and radius."""
    hexagon = []
    for i in range(6):
        angle = math.radians(i * 60)  # 60 degrees between vertices
        x = center.X + radius * math.cos(angle)
        y = center.Y + radius * math.sin(angle)
        hexagon.append(rg.Point3d(x, y, center.Z))
    hexagon.append(hexagon[0])  # Close the loop
    return hexagon

def create_pyramids(hex_centers, radius, height):
    """Create pyramids within each hexagon."""
    pyramids = []
    for center in hex_centers:
        # Create the hexagon vertices
        hexagon = create_hexagon(center, radius)
        
        # Compute the pyramid apex (center point, elevated)
        apex = rg.Point3d(center.X, center.Y, center.Z + height)
        
        # Create triangular faces of the pyramid
        for i in range(len(hexagon) - 1):
            p1 = hexagon[i]
            p2 = hexagon[i + 1]
            pyramids.append(rg.Polyline([p1, p2, apex, p1]).ToNurbsCurve())
    
    return pyramids

# Parameters
hex_radius = 1.0  # Radius of each hexagon
rows = 5  # Number of rows in the grid
cols = 5  # Number of columns in the grid
pyramid_height = 1.0  # Height of the pyramid

try:
    # Step 1: Create hexagonal grid centers
    hex_centers = create_hexagonal_grid(hex_radius, rows, cols)
    
    # Step 2: Create pyramids within each hexagon
    pyramid_geometry = create_pyramids(hex_centers, hex_radius, pyramid_height)
    
    # Output the pyramids
    a = pyramid_geometry
except Exception as e:
    # Debugging: Output the error message
    a = "Error: {}".format(str(e))
# ---------- end iteration_7_5 ----------
iteration_7_6 = GhPythonScript()  # -> out, a
# ---------- iteration_7_6: Python ----------
import Rhino.Geometry as rg
import math

def create_hexagonal_grid(radius, rows, cols):
    """Create a hexagonal grid of points."""
    centers = []
    height = math.sqrt(3) * radius  # Height of the hexagon

    for i in range(rows):
        for j in range(cols):
            # Calculate the position of each hexagon center
            x = j * 1.5 * radius
            y = i * height
            if j % 2 == 1:  # Shift alternate columns
                y += height / 2
            centers.append(rg.Point3d(x, y, 0))

    return centers

def create_hexagon(center, radius):
    """Create a hexagon given a center and radius."""
    hexagon = []
    for i in range(6):
        angle = math.radians(i * 60)  # 60 degrees between vertices
        x = center.X + radius * math.cos(angle)
        y = center.Y + radius * math.sin(angle)
        hexagon.append(rg.Point3d(x, y, center.Z))
    return hexagon

def create_pyramids(hex_centers, radius, height):
    """Create pyramids within each hexagon."""
    pyramids = []
    for center in hex_centers:
        # Create the hexagon vertices
        hexagon = create_hexagon(center, radius)
        
        # Compute the pyramid apex (center point, elevated)
        apex = rg.Point3d(center.X, center.Y, center.Z + height)
        
        # Divide hexagon into 6 triangles and create pyramid faces
        for i in range(len(hexagon)):
            p1 = hexagon[i]
            p2 = hexagon[(i + 1) % len(hexagon)]  # Wrap around to first vertex
            pyramids.append(rg.Polyline([p1, p2, apex, p1]).ToNurbsCurve())
    
    return pyramids

# Parameters
hex_radius = 1.0  # Radius of each hexagon
rows = 5  # Number of rows in the grid
cols = 5  # Number of columns in the grid
pyramid_height = 1.0  # Height of the pyramid

try:
    # Step 1: Create hexagonal grid centers
    hex_centers = create_hexagonal_grid(hex_radius, rows, cols)
    
    # Step 2: Create pyramids within each hexagon
    pyramid_geometry = create_pyramids(hex_centers, hex_radius, pyramid_height)
    
    # Output the pyramids
    a = pyramid_geometry
except Exception as e:
    # Debugging: Output the error message
    a = "Error: {}".format(str(e))
# ---------- end iteration_7_6 ----------
iteration_7_7 = GhPythonScript()  # -> out, a
# ---------- iteration_7_7: Python ----------
import Rhino.Geometry as rg
import math

def create_hexagonal_grid(radius, rows, cols):
    """Create a hexagonal grid of centers."""
    centers = []
    height = math.sqrt(3) * radius  # Height of the hexagon

    for i in range(rows):
        for j in range(cols):
            # Calculate the position of each hexagon center
            x = j * 1.5 * radius
            y = i * height
            if j % 2 == 1:  # Shift alternate columns
                y += height / 2
            centers.append(rg.Point3d(x, y, 0))

    return centers

def create_hexagon(center, radius):
    """Create a hexagon given its center and radius."""
    hexagon = []
    for i in range(6):
        angle = math.radians(i * 60)  # 60 degrees between vertices
        x = center.X + radius * math.cos(angle)
        y = center.Y + radius * math.sin(angle)
        hexagon.append(rg.Point3d(x, y, center.Z))
    return hexagon

def create_pyramid_from_hexagon(center, hexagon, height):
    """Create a pyramid inside a hexagon by dividing it into six triangles."""
    apex = rg.Point3d(center.X, center.Y, center.Z + height)  # Elevated apex
    pyramid_faces = []

    for i in range(len(hexagon)):
        # Create a triangle for each edge of the hexagon
        p1 = hexagon[i]
        p2 = hexagon[(i + 1) % len(hexagon)]  # Wrap around to the first point
        pyramid_faces.append(rg.Polyline([p1, p2, apex, p1]).ToNurbsCurve())

    return pyramid_faces

# Parameters
hex_radius = 1.0  # Radius of each hexagon
rows = 5  # Number of rows in the grid
cols = 5  # Number of columns in the grid
pyramid_height = 1.0  # Height of the pyramid apex above the center

try:
    # Step 1: Create hexagonal grid centers
    hex_centers = create_hexagonal_grid(hex_radius, rows, cols)
    
    # Step 2: Create hexagonal pyramids
    pyramids = []
    for center in hex_centers:
        # Step 2a: Create the hexagon for the current center
        hexagon = create_hexagon(center, hex_radius)
        
        # Step 2b: Create a pyramid from the hexagon
        pyramid_faces = create_pyramid_from_hexagon(center, hexagon, pyramid_height)
        
        # Add the pyramid faces to the list
        pyramids.extend(pyramid_faces)
    
    # Output all the pyramids
    a = pyramids
except Exception as e:
    # Debugging: Output the error message
    a = "Error: {}".format(str(e))
# ---------- end iteration_7_7 ----------
iteration_7_8 = GhPythonScript()  # -> out, a
# ---------- iteration_7_8: Python ----------
import Rhino.Geometry as rg
import math

def create_hexagonal_grid(radius, rows, cols):
    """Create a hexagonal grid of centers."""
    centers = []
    height = math.sqrt(3) * radius  # Height of the hexagon

    for i in range(rows):
        for j in range(cols):
            # Calculate the position of each hexagon center
            x = j * 1.5 * radius
            y = i * height
            if j % 2 == 1:  # Shift alternate columns
                y += height / 2
            centers.append(rg.Point3d(x, y, 0))

    return centers

def create_hexagon(center, radius):
    """Create a hexagon given its center and radius."""
    hexagon = []
    for i in range(6):
        angle = math.radians(i * 60)  # 60 degrees between vertices
        x = center.X + radius * math.cos(angle)
        y = center.Y + radius * math.sin(angle)
        hexagon.append(rg.Point3d(x, y, center.Z))
    hexagon.append(hexagon[0])  # Close the hexagon loop
    return hexagon

def split_hexagon_into_triangles(hexagon):
    """Split a hexagon into 6 triangles."""
    center = rg.Point3d(
        sum([pt.X for pt in hexagon[:-1]]) / 6,
        sum([pt.Y for pt in hexagon[:-1]]) / 6,
        hexagon[0].Z
    )
    triangles = []
    for i in range(len(hexagon) - 1):  # Skip the last point (it's a duplicate of the first)
        triangles.append([hexagon[i], hexagon[i + 1], center])
    return triangles

def create_pyramids_from_triangles(triangles, height):
    """Create pyramids for each triangle."""
    pyramids = []
    for triangle in triangles:
        # Compute the apex of the pyramid
        apex = rg.Point3d(
            (triangle[0].X + triangle[1].X + triangle[2].X) / 3,
            (triangle[0].Y + triangle[1].Y + triangle[2].Y) / 3,
            triangle[0].Z + height
        )
        # Create the pyramid faces (triangular surfaces)
        for i in range(3):
            p1 = triangle[i]
            p2 = triangle[(i + 1) % 3]  # Wrap around to the first vertex
            pyramids.append(rg.Polyline([p1, p2, apex, p1]).ToNurbsCurve())
    return pyramids

# Parameters
hex_radius = 1.0  # Radius of each hexagon
rows = 5  # Number of rows in the grid
cols = 5  # Number of columns in the grid
pyramid_height = 1.0  # Height of each pyramid

try:
    # Step 1: Create hexagonal grid centers
    hex_centers = create_hexagonal_grid(hex_radius, rows, cols)
    
    # Step 2: Generate hexagons and split them into triangles
    pyramids = []
    for center in hex_centers:
        # Create hexagon
        hexagon = create_hexagon(center, hex_radius)
        
        # Split hexagon into 6 triangles
        triangles = split_hexagon_into_triangles(hexagon)
        
        # Step 3: Create pyramids from the triangles
        pyramid_faces = create_pyramids_from_triangles(triangles, pyramid_height)
        
        # Add the pyramid faces to the list
        pyramids.extend(pyramid_faces)
    
    # Output all pyramids
    a = pyramids
except Exception as e:
    # Debugging: Output the error message
    a = "Error: {}".format(str(e))
# ---------- end iteration_7_8 ----------
iteration_7_9 = GhPythonScript()  # -> out, a
# ---------- iteration_7_9: Python ----------
import Rhino.Geometry as rg
import math

def create_hexagonal_grid(radius, rows, cols):
    """Create a hexagonal grid of centers."""
    centers = []
    height = math.sqrt(3) * radius  # Height of the hexagon

    for i in range(rows):
        for j in range(cols):
            # Calculate the position of each hexagon center
            x = j * 1.5 * radius
            y = i * height
            if j % 2 == 1:  # Shift alternate columns
                y += height / 2
            centers.append(rg.Point3d(x, y, 0))

    return centers

def create_hexagon(center, radius):
    """Create a hexagon given its center and radius."""
    hexagon = []
    for i in range(6):
        angle = math.radians(i * 60)  # 60 degrees between vertices
        x = center.X + radius * math.cos(angle)
        y = center.Y + radius * math.sin(angle)
        hexagon.append(rg.Point3d(x, y, center.Z))
    hexagon.append(hexagon[0])  # Close the hexagon loop
    return hexagon

def split_hexagon_into_triangles(hexagon):
    """Split a hexagon into 6 triangles."""
    center = rg.Point3d(
        sum([pt.X for pt in hexagon[:-1]]) / 6,
        sum([pt.Y for pt in hexagon[:-1]]) / 6,
        hexagon[0].Z
    )
    triangles = []
    for i in range(len(hexagon) - 1):  # Skip the last point (it's a duplicate of the first)
        triangles.append([hexagon[i], hexagon[i + 1], center])
    return triangles

def create_pyramids_from_triangles(triangles, height):
    """Create pyramids for each triangle."""
    pyramids = []
    for triangle in triangles:
        # Compute the apex of the pyramid
        apex = rg.Point3d(
            (triangle[0].X + triangle[1].X + triangle[2].X) / 3,
            (triangle[0].Y + triangle[1].Y + triangle[2].Y) / 3,
            triangle[0].Z + height
        )
        # Create the pyramid faces (triangular surfaces)
        for i in range(3):
            p1 = triangle[i]
            p2 = triangle[(i + 1) % 3]  # Wrap around to the first vertex
            pyramids.append(rg.Polyline([p1, p2, apex, p1]).ToNurbsCurve())
    return pyramids

def is_within_boundary(hexagon, boundary):
    """Check if a hexagon is fully within the rectangular boundary."""
    for vertex in hexagon[:-1]:  # Exclude the duplicate closing point
        if not boundary.Contains(vertex):
            return False
    return True

# Parameters
hex_radius = 1.0  # Radius of each hexagon
rows = 10  # Number of rows in the grid
cols = 10  # Number of columns in the grid
pyramid_height = 1.0  # Height of each pyramid
boundary_width = 10.0  # Width of the rectangular boundary
boundary_height = 10.0  # Height of the rectangular boundary

try:
    # Step 1: Create hexagonal grid centers
    hex_centers = create_hexagonal_grid(hex_radius, rows, cols)
    
    # Step 2: Define the rectangular boundary
    boundary = rg.Rectangle3d(
        rg.Plane.WorldXY,
        rg.Interval(0, boundary_width),
        rg.Interval(0, boundary_height)
    ).ToNurbsCurve()
    
    # Step 3: Generate hexagons, split into triangles, and create pyramids
    pyramids = []
    for center in hex_centers:
        # Create hexagon
        hexagon = create_hexagon(center, hex_radius)
        
        # Check if hexagon is fully within the rectangular boundary
        if is_within_boundary(hexagon, boundary):
            # Split hexagon into 6 triangles
            triangles = split_hexagon_into_triangles(hexagon)
            
            # Create pyramids from the triangles
            pyramid_faces = create_pyramids_from_triangles(triangles, pyramid_height)
            
            # Add the pyramid faces to the list
            pyramids.extend(pyramid_faces)
    
    # Output all pyramids
    a = pyramids
    b = boundary  # Output the rectangular boundary for reference
except Exception as e:
    # Debugging: Output the error message
    a = "Error: {}".format(str(e))
    b = None
# ---------- end iteration_7_9 ----------
iteration_7_10 = GhPythonScript()  # -> out, a
# ---------- iteration_7_10: Python ----------
import Rhino.Geometry as rg
import math

def create_hexagonal_grid(radius, rows, cols):
    """Create a hexagonal grid of centers."""
    centers = []
    height = math.sqrt(3) * radius  # Height of the hexagon

    for i in range(rows):
        for j in range(cols):
            # Calculate the position of each hexagon center
            x = j * 1.5 * radius
            y = i * height
            if j % 2 == 1:  # Shift alternate columns
                y += height / 2
            centers.append(rg.Point3d(x, y, 0))

    return centers

def create_hexagon(center, radius):
    """Create a hexagon given its center and radius."""
    hexagon = []
    for i in range(6):
        angle = math.radians(i * 60)  # 60 degrees between vertices
        x = center.X + radius * math.cos(angle)
        y = center.Y + radius * math.sin(angle)
        hexagon.append(rg.Point3d(x, y, center.Z))
    hexagon.append(hexagon[0])  # Close the hexagon loop
    return hexagon

def split_hexagon_into_triangles(hexagon):
    """Split a hexagon into 6 triangles."""
    center = rg.Point3d(
        sum([pt.X for pt in hexagon[:-1]]) / 6,
        sum([pt.Y for pt in hexagon[:-1]]) / 6,
        hexagon[0].Z
    )
    triangles = []
    for i in range(len(hexagon) - 1):  # Skip the last point (it's a duplicate of the first)
        triangles.append([hexagon[i], hexagon[i + 1], center])
    return triangles

def create_pyramids_from_triangles(triangles, height):
    """Create pyramids for each triangle and output surfaces."""
    pyramid_surfaces = []
    for triangle in triangles:
        # Compute the apex of the pyramid
        apex = rg.Point3d(
            (triangle[0].X + triangle[1].X + triangle[2].X) / 3,
            (triangle[0].Y + triangle[1].Y + triangle[2].Y) / 3,
            triangle[0].Z + height
        )
        # Create triangular faces as surfaces
        for i in range(3):
            p1 = triangle[i]
            p2 = triangle[(i + 1) % 3]  # Wrap around to the first vertex
            pyramid_surfaces.append(rg.Brep.CreateFromCornerPoints(p1, p2, apex, 0.001))
    return pyramid_surfaces

def is_within_boundary(hexagon, boundary):
    """Check if a hexagon is fully within the rectangular boundary."""
    for vertex in hexagon[:-1]:  # Exclude the duplicate closing point
        if not boundary.Contains(vertex):
            return False
    return True

# Parameters
hex_radius = 1.0  # Radius of each hexagon
rows = 10  # Number of rows in the grid
cols = 10  # Number of columns in the grid
pyramid_height = 1.0  # Height of each pyramid
boundary_width = 10.0  # Width of the rectangular boundary
boundary_height = 10.0  # Height of the rectangular boundary

try:
    # Step 1: Create hexagonal grid centers
    hex_centers = create_hexagonal_grid(hex_radius, rows, cols)
    
    # Step 2: Define the rectangular boundary
    boundary = rg.Rectangle3d(
        rg.Plane.WorldXY,
        rg.Interval(0, boundary_width),
        rg.Interval(0, boundary_height)
    )
    
    # Step 3: Generate hexagons, split into triangles, and create pyramids
    pyramids = []
    for center in hex_centers:
        # Create hexagon
        hexagon = create_hexagon(center, hex_radius)
        
        # Check if hexagon is fully within the rectangular boundary
        if is_within_boundary(hexagon, boundary):
            # Split hexagon into 6 triangles
            triangles = split_hexagon_into_triangles(hexagon)
            
            # Create pyramids from the triangles
            pyramid_faces = create_pyramids_from_triangles(triangles, pyramid_height)
            
            # Add the pyramid surfaces to the list
            pyramids.extend(pyramid_faces)
    
    # Output all pyramid surfaces
    a = pyramids
    b = boundary.ToNurbsCurve()  # Output the rectangular boundary for reference
except Exception as e:
    # Debugging: Output the error message
    a = "Error: {}".format(str(e))
    b = None
# ---------- end iteration_7_10 ----------
iteration_7_11 = GhPythonScript()  # -> out, a
# ---------- iteration_7_11: Python ----------
import Rhino.Geometry as rg

def create_triangular_grid(grid_width, grid_height, step_size):
    """Create a triangular grid of points."""
    points = []
    for i in range(int(grid_height / step_size) + 1):
        row = []
        for j in range(int(grid_width / step_size) + 1):
            x = j * step_size
            y = i * step_size * 0.866  # Multiply by sin(60°) to create equilateral triangles
            if i % 2 == 1:  # Offset alternate rows
                x += step_size / 2
            row.append(rg.Point3d(x, y, 0))
        points.append(row)
    return points

def create_triangles_from_grid(points):
    """Create triangles from a triangular grid of points."""
    triangles = []
    for i in range(len(points) - 1):
        for j in range(len(points[i]) - 1):
            # Create two triangles per square
            p1 = points[i][j]
            p2 = points[i][j + 1]
            p3 = points[i + 1][j]
            p4 = points[i + 1][j + 1]
            
            if i % 2 == j % 2:  # Flip the diagonal for staggered rows
                triangles.append([p1, p3, p2])
                triangles.append([p3, p4, p2])
            else:
                triangles.append([p1, p4, p2])
                triangles.append([p1, p3, p4])
    return triangles

def create_pyramids_from_triangles(triangles, height):
    """Create pyramids for each triangle."""
    pyramids = []
    for triangle in triangles:
        # Compute the apex of the pyramid
        apex = rg.Point3d(
            (triangle[0].X + triangle[1].X + triangle[2].X) / 3,
            (triangle[0].Y + triangle[1].Y + triangle[2].Y) / 3,
            height
        )
        # Create triangular faces as surfaces
        for i in range(3):
            p1 = triangle[i]
            p2 = triangle[(i + 1) % 3]  # Wrap around to the first vertex
            pyramids.append(rg.Brep.CreateFromCornerPoints(p1, p2, apex, 0.001))
    return pyramids

# Parameters
grid_width = 10.0  # Width of the triangular grid
grid_height = 10.0  # Height of the triangular grid
step_size = 1.0  # Size of each triangle's side
pyramid_height = 1.0  # Height of each pyramid

try:
    # Step 1: Create triangular grid of points
    grid_points = create_triangular_grid(grid_width, grid_height, step_size)
    
    # Step 2: Create triangles from the grid points
    triangles = create_triangles_from_grid(grid_points)
    
    # Step 3: Create pyramids from the triangles
    pyramid_surfaces = create_pyramids_from_triangles(triangles, pyramid_height)
    
    # Output the pyramid surfaces
    a = pyramid_surfaces
except Exception as e:
    # Debugging: Output the error message
    a = "Error: {}".format(str(e))
# ---------- end iteration_7_11 ----------

srf = Surface(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)
iteration_8_2 = GhPythonScript(
    surface=srf,
    grid_size_x=Slider(12, range=0..100),
    grid_size_y=Slider(12, range=0..100),
    cell_size=Slider(4, range=1..10),
    offset_distance=Slider(0.425, range=0..1),
    second_offset_distance=Slider(0.7, range=0..10),
    downward_distance=Slider(0.63, range=-4..4))  # -> out, a, b, c, d, e; inputs surface: Surface, grid_size_x: Int32, grid_size_y: Int32
# ---------- iteration_8_2: Python ----------
import Rhino.Geometry as rg

# Ensure the input surface is valid
if isinstance(surface, rg.Brep):
    # Convert Brep to a surface
    if len(surface.Faces) > 0:
        surface = surface.Faces[0].ToNurbsSurface()
elif isinstance(surface, rg.Surface):
    # The input is already a Surface
    surface = surface
else:
    raise ValueError("Please provide a valid Rhino Surface or Brep as input.")

# Function to project vertically, offset twice, and loft
def project_offset_and_loft_vertically(surface, grid_size_x, grid_size_y, cell_size, offset_distance, second_offset_distance, downward_distance):
    rectangles = []  # Original projected rectangles
    offsets_1 = []   # First inward offset
    offsets_2 = []   # Second inward offset + downward movement
    lofts_1 = []     # Lofts between original and first offset
    lofts_2 = []     # Lofts between first and second offset

    for i in range(grid_size_x):
        for j in range(grid_size_y):
            # Create flat grid points
            p1 = rg.Point3d(i * cell_size, j * cell_size, 0)
            p2 = rg.Point3d((i + 1) * cell_size, j * cell_size, 0)
            p3 = rg.Point3d((i + 1) * cell_size, (j + 1) * cell_size, 0)
            p4 = rg.Point3d(i * cell_size, (j + 1) * cell_size, 0)

            # Project grid points vertically onto the surface
            def project_point_vertically(point, surface):
                vertical_line = rg.Line(point, point + rg.Vector3d(0, 0, -1000))  # Long vertical line downward
                intersections = rg.Intersect.Intersection.CurveSurface(
                    rg.LineCurve(vertical_line),
                    surface,
                    0.01,  # Tolerance
                    0.01   # Overlap tolerance
                )
                if intersections and intersections.Count > 0:
                    return intersections[0].PointA
                else:
                    return None  # Return None if no intersection is found
            
            # Project each corner of the rectangle
            pt1 = project_point_vertically(p1, surface)
            pt2 = project_point_vertically(p2, surface)
            pt3 = project_point_vertically(p3, surface)
            pt4 = project_point_vertically(p4, surface)

            # Skip this grid cell if any projection fails
            if None in [pt1, pt2, pt3, pt4]:
                continue

            # Compute the center of the grid cell
            cell_center = rg.Point3d((pt1.X + pt3.X) / 2, (pt1.Y + pt3.Y) / 2, (pt1.Z + pt3.Z) / 2)

            # Create the original rectangle
            original_corners = [pt1, pt2, pt3, pt4, pt1]
            original_curve = rg.Polyline(original_corners).ToNurbsCurve()
            rectangles.append(original_curve)

            # Offset each vertex toward the center (first inward offset)
            offset_corners_1 = [
                pt + (cell_center - pt) * (offset_distance / cell_center.DistanceTo(pt))
                for pt in [pt1, pt2, pt3, pt4]
            ]
            offset_corners_1.append(offset_corners_1[0])  # Close the loop
            offset_curve_1 = rg.Polyline(offset_corners_1).ToNurbsCurve()
            offsets_1.append(offset_curve_1)

            # Loft between original and first offset
            loft_1 = rg.Brep.CreateFromLoft(
                [original_curve, offset_curve_1],
                rg.Point3d.Unset,
                rg.Point3d.Unset,
                rg.LoftType.Normal,
                False
            )
            if loft_1 and len(loft_1) > 0:
                lofts_1.append(loft_1[0])

            # Offset the first offset inward again (second inward offset)
            offset_corners_2 = [
                pt + (cell_center - pt) * (second_offset_distance / cell_center.DistanceTo(pt))
                for pt in offset_corners_1[:-1]
            ]
            offset_corners_2.append(offset_corners_2[0])  # Close the loop

            # Move the second offset downward
            offset_corners_2 = [
                pt + rg.Vector3d(0, 0, -downward_distance) for pt in offset_corners_2
            ]
            offset_curve_2 = rg.Polyline(offset_corners_2).ToNurbsCurve()
            offsets_2.append(offset_curve_2)

            # Loft between first and second offset
            loft_2 = rg.Brep.CreateFromLoft(
                [offset_curve_1, offset_curve_2],
                rg.Point3d.Unset,
                rg.Point3d.Unset,
                rg.LoftType.Normal,
                False
            )
            if loft_2 and len(loft_2) > 0:
                lofts_2.append(loft_2[0])

    return rectangles, offsets_1, offsets_2, lofts_1, lofts_2

# Parameters
#offset_distance = 0.1           # First inward offset distance
#second_offset_distance = 0.05   # Second inward offset distance
#downward_distance = 0.1         # Downward movement distance for the second offset

# Generate the projected grid, offsets, and lofts
rectangles, offsets_1, offsets_2, lofts_1, lofts_2 = project_offset_and_loft_vertically(
    surface, grid_size_x, grid_size_y, cell_size, offset_distance, second_offset_distance, downward_distance
)

# Outputs
a = rectangles  # Original projected rectangles
b = offsets_1   # First inward-offset rectangles
c = offsets_2   # Second inward-offset rectangles, moved downward
d = lofts_1     # Lofts between original and first offset
e = lofts_2     # Lofts between first and second offset
# ---------- end iteration_8_2 ----------
geo_5 = Geometry(iteration_8_2.b)
geo_6 = Geometry(iteration_8_2.e)
geo_7 = Geometry(iteration_8_2.a)
geo_8 = Geometry(iteration_8_2.c)
geo_9 = Geometry(iteration_8_2.d)
geo_10 = Geometry([geo_9, geo_6])

number_slider_4 = Slider(15, range=0..100)
number_slider_5 = Slider(15, range=0..100)
srf_2 = Surface(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)
iteration_8_19 = GhPythonScript(
    surface=srf_2,
    grid_size_x=number_slider_5,
    grid_size_y=number_slider_5,
    cell_size=Slider(4, range=1..10),
    offset_distance=Slider(0.184, range=0..1),
    second_offset_distance=Slider(0.9, range=0..10),
    downward_distance=Slider(0.6, range=0..4))  # -> out, a, b, c, d, e; inputs surface: Surface, grid_size_x: Int32, grid_size_y: Int32
# ---------- iteration_8_19: Python ----------
import Rhino.Geometry as rg

# Ensure the input surface is valid
if isinstance(surface, rg.Brep):
    # Convert Brep to a surface
    if len(surface.Faces) > 0:
        surface = surface.Faces[0].ToNurbsSurface()
elif isinstance(surface, rg.Surface):
    # The input is already a Surface
    surface = surface
else:
    raise ValueError("Please provide a valid Rhino Surface or Brep as input.")

# Function to project the grid onto the surface, offset twice, and loft
def project_offset_and_loft(surface, grid_size_x, grid_size_y, cell_size, offset_distance, second_offset_distance, downward_distance):
    rectangles = []  # Original projected rectangles
    offsets_1 = []   # First inward offset
    offsets_2 = []   # Second inward offset + downward movement
    lofts_1 = []     # Lofts between original and first offset
    lofts_2 = []     # Lofts between first offset and second offset
    
    for i in range(grid_size_x):
        for j in range(grid_size_y):
            # Create flat grid points
            p1 = rg.Point3d(i * cell_size, j * cell_size, 0)
            p2 = rg.Point3d((i + 1) * cell_size, j * cell_size, 0)
            p3 = rg.Point3d((i + 1) * cell_size, (j + 1) * cell_size, 0)
            p4 = rg.Point3d(i * cell_size, (j + 1) * cell_size, 0)

            # Find corresponding UV coordinates on the surface
            _, u1, v1 = surface.ClosestPoint(p1)
            _, u2, v2 = surface.ClosestPoint(p2)
            _, u3, v3 = surface.ClosestPoint(p3)
            _, u4, v4 = surface.ClosestPoint(p4)

            # Project points onto the surface
            pt1 = surface.PointAt(u1, v1)
            pt2 = surface.PointAt(u2, v2)
            pt3 = surface.PointAt(u3, v3)
            pt4 = surface.PointAt(u4, v4)

            # Compute the center of the grid cell
            cell_center = rg.Point3d((pt1.X + pt3.X) / 2, (pt1.Y + pt3.Y) / 2, (pt1.Z + pt3.Z) / 2)

            # Create the original rectangle
            original_corners = [pt1, pt2, pt3, pt4, pt1]
            original_curve = rg.Polyline(original_corners).ToNurbsCurve()
            rectangles.append(original_curve)

            # Offset each vertex toward the center (first inward offset)
            offset_corners_1 = [
                pt + (cell_center - pt) * (offset_distance / cell_center.DistanceTo(pt))
                for pt in [pt1, pt2, pt3, pt4]
            ]
            offset_corners_1.append(offset_corners_1[0])  # Close the loop
            offset_curve_1 = rg.Polyline(offset_corners_1).ToNurbsCurve()
            offsets_1.append(offset_curve_1)

            # Loft between original and first offset
            loft_1 = rg.Brep.CreateFromLoft(
                [original_curve, offset_curve_1],
                rg.Point3d.Unset,
                rg.Point3d.Unset,
                rg.LoftType.Normal,
                False
            )
            if loft_1 and len(loft_1) > 0:
                lofts_1.append(loft_1[0])

            # Offset the first offset inward again (second inward offset)
            offset_corners_2 = [
                pt + (cell_center - pt) * (second_offset_distance / cell_center.DistanceTo(pt))
                for pt in offset_corners_1[:-1]
            ]
            offset_corners_2.append(offset_corners_2[0])  # Close the loop

            # Move the second offset downward
            offset_corners_2 = [
                pt + rg.Vector3d(0, 0, -downward_distance) for pt in offset_corners_2
            ]
            offset_curve_2 = rg.Polyline(offset_corners_2).ToNurbsCurve()
            offsets_2.append(offset_curve_2)

            # Loft between first and second offset
            loft_2 = rg.Brep.CreateFromLoft(
                [offset_curve_1, offset_curve_2],
                rg.Point3d.Unset,
                rg.Point3d.Unset,
                rg.LoftType.Normal,
                False
            )
            if loft_2 and len(loft_2) > 0:
                lofts_2.append(loft_2[0])

    return rectangles, offsets_1, offsets_2, lofts_1, lofts_2

# Parameters
#offset_distance = 0.1           # First inward offset distance
#second_offset_distance = 0.05   # Second inward offset distance
#downward_distance = 0.1         # Downward movement distance for the second offset

# Generate the projected grid, offsets, and lofts
rectangles, offsets_1, offsets_2, lofts_1, lofts_2 = project_offset_and_loft(
    surface, grid_size_x, grid_size_y, cell_size, offset_distance, second_offset_distance, downward_distance
)

# Outputs
a = rectangles  # Original projected rectangles
b = offsets_1   # First inward-offset rectangles
c = offsets_2   # Second inward-offset rectangles, moved downward
d = lofts_1     # Lofts between original and first offset
e = lofts_2     # Lofts between first and second offset
# ---------- end iteration_8_19 ----------
geo_11 = Geometry(iteration_8_19.a)
geo_12 = Geometry(iteration_8_19.e)
geo_13 = Geometry(iteration_8_19.b)
geo_14 = Geometry(iteration_8_19.c)
geo_15 = Geometry(iteration_8_19.d)

number_slider_6 = Slider(15, range=0..100)
srf_3 = Surface(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)
iteration_8_17 = GhPythonScript(
    surface=srf_3,
    grid_size_x=number_slider_6,
    grid_size_y=number_slider_6,
    cell_size=Slider(4, range=1..10),
    offset_distance=Slider(0.313, range=0..1),
    second_offset_distance=Slider(0.9, range=0..10),
    downward_distance=Slider(0.76, range=0..4))  # -> out, a, b, c; inputs surface: Surface, grid_size_x: Int32, grid_size_y: Int32
# ---------- iteration_8_17: Python ----------
import Rhino.Geometry as rg

# Ensure the input surface is valid
if isinstance(surface, rg.Brep):
    # Convert Brep to a surface
    if len(surface.Faces) > 0:
        surface = surface.Faces[0].ToNurbsSurface()
elif isinstance(surface, rg.Surface):
    # The input is already a Surface
    surface = surface
else:
    raise ValueError("Please provide a valid Rhino Surface or Brep as input.")

# Function to project the grid onto the surface, offset twice, and move the second offset downward
def project_and_offset_twice(surface, grid_size_x, grid_size_y, cell_size, offset_distance, second_offset_distance, downward_distance):
    rectangles = []  # Original projected rectangles
    offsets_1 = []   # First inward offset
    offsets_2 = []   # Second inward offset + downward movement
    
    for i in range(grid_size_x):
        for j in range(grid_size_y):
            # Create flat grid points
            p1 = rg.Point3d(i * cell_size, j * cell_size, 0)
            p2 = rg.Point3d((i + 1) * cell_size, j * cell_size, 0)
            p3 = rg.Point3d((i + 1) * cell_size, (j + 1) * cell_size, 0)
            p4 = rg.Point3d(i * cell_size, (j + 1) * cell_size, 0)

            # Find corresponding UV coordinates on the surface
            _, u1, v1 = surface.ClosestPoint(p1)
            _, u2, v2 = surface.ClosestPoint(p2)
            _, u3, v3 = surface.ClosestPoint(p3)
            _, u4, v4 = surface.ClosestPoint(p4)

            # Project points onto the surface
            pt1 = surface.PointAt(u1, v1)
            pt2 = surface.PointAt(u2, v2)
            pt3 = surface.PointAt(u3, v3)
            pt4 = surface.PointAt(u4, v4)

            # Create the original rectangle
            original_corners = [pt1, pt2, pt3, pt4, pt1]
            original_curve = rg.Polyline(original_corners).ToNurbsCurve()
            rectangles.append(original_curve)

            # Offset the rectangle inward (first offset)
            plane = rg.Plane.FitPlaneToPoints(original_corners[:-1])[1]  # Fit plane to rectangle
            offset_curve_1 = original_curve.Offset(
                plane, 
                -offset_distance,  # Negative for inward offset
                0.01,  # Tolerance
                rg.CurveOffsetCornerStyle.Sharp
            )

            if offset_curve_1 and len(offset_curve_1) > 0:
                offset_1 = offset_curve_1[0]  # First offset result
                offsets_1.append(offset_1)

                # Offset the first offset inward again (second offset)
                offset_curve_2 = offset_1.Offset(
                    plane,
                    -second_offset_distance,  # Negative for inward offset
                    0.01,  # Tolerance
                    rg.CurveOffsetCornerStyle.Sharp
                )
                
                # Move the second offset downward
                if offset_curve_2 and len(offset_curve_2) > 0:
                    offset_2 = offset_curve_2[0]
                    downward_translation = rg.Vector3d(0, 0, -downward_distance)  # Create a downward vector
                    offset_2.Translate(downward_translation)  # Apply downward translation
                    offsets_2.append(offset_2)

    return rectangles, offsets_1, offsets_2

# Parameters
#offset_distance = 0.1           # First inward offset distance
#second_offset_distance = 0.05   # Second inward offset distance
#downward_distance = 0.1         # Downward movement distance for the second offset

# Generate the projected grid, first offsets, and second offsets
rectangles, offsets_1, offsets_2 = project_and_offset_twice(
    surface, grid_size_x, grid_size_y, cell_size, offset_distance, second_offset_distance, downward_distance
)

# Outputs
a = rectangles  # Original projected rectangles
b = offsets_1   # First inward-offset rectangles
c = offsets_2   # Second inward-offset rectangles, moved downward
# ---------- end iteration_8_17 ----------
geo_16 = Geometry(iteration_8_17.a)
geo_17 = Geometry(iteration_8_17.c)
geo_18 = Geometry(iteration_8_17.b)

number_slider_7 = Slider(15, range=0..100)
srf_4 = Surface(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)
iteration_8_18 = GhPythonScript(
    surface=srf_4,
    grid_size_x=number_slider_7,
    grid_size_y=number_slider_7,
    cell_size=Slider(4, range=1..10),
    offset_distance=Slider(0.313, range=0..1),
    second_offset_distance=Slider(0.9, range=0..10),
    downward_distance=Slider(0.3, range=0..4))  # -> out, a, b, c; inputs surface: Surface, grid_size_x: Int32, grid_size_y: Int32
# ---------- iteration_8_18: Python ----------
import Rhino.Geometry as rg

# Ensure the input surface is valid
if isinstance(surface, rg.Brep):
    # Convert Brep to a surface
    if len(surface.Faces) > 0:
        surface = surface.Faces[0].ToNurbsSurface()
elif isinstance(surface, rg.Surface):
    # The input is already a Surface
    surface = surface
else:
    raise ValueError("Please provide a valid Rhino Surface or Brep as input.")

# Function to project the grid onto the surface, offset twice, and move the second offset downward
def project_and_offset_consistently(surface, grid_size_x, grid_size_y, cell_size, offset_distance, second_offset_distance, downward_distance):
    rectangles = []  # Original projected rectangles
    offsets_1 = []   # First inward offset
    offsets_2 = []   # Second inward offset + downward movement
    
    for i in range(grid_size_x):
        for j in range(grid_size_y):
            # Create flat grid points
            p1 = rg.Point3d(i * cell_size, j * cell_size, 0)
            p2 = rg.Point3d((i + 1) * cell_size, j * cell_size, 0)
            p3 = rg.Point3d((i + 1) * cell_size, (j + 1) * cell_size, 0)
            p4 = rg.Point3d(i * cell_size, (j + 1) * cell_size, 0)

            # Find corresponding UV coordinates on the surface
            _, u1, v1 = surface.ClosestPoint(p1)
            _, u2, v2 = surface.ClosestPoint(p2)
            _, u3, v3 = surface.ClosestPoint(p3)
            _, u4, v4 = surface.ClosestPoint(p4)

            # Project points onto the surface
            pt1 = surface.PointAt(u1, v1)
            pt2 = surface.PointAt(u2, v2)
            pt3 = surface.PointAt(u3, v3)
            pt4 = surface.PointAt(u4, v4)

            # Compute the center of the grid cell
            cell_center = rg.Point3d((pt1.X + pt3.X) / 2, (pt1.Y + pt3.Y) / 2, (pt1.Z + pt3.Z) / 2)

            # Create the original rectangle
            original_corners = [pt1, pt2, pt3, pt4, pt1]
            original_curve = rg.Polyline(original_corners).ToNurbsCurve()
            rectangles.append(original_curve)

            # Offset each vertex toward the center (first inward offset)
            offset_corners_1 = [
                pt + (cell_center - pt) * (offset_distance / cell_center.DistanceTo(pt))
                for pt in [pt1, pt2, pt3, pt4]
            ]
            offset_corners_1.append(offset_corners_1[0])  # Close the loop
            offset_curve_1 = rg.Polyline(offset_corners_1).ToNurbsCurve()
            offsets_1.append(offset_curve_1)

            # Offset the first offset inward again (second inward offset)
            offset_corners_2 = [
                pt + (cell_center - pt) * (second_offset_distance / cell_center.DistanceTo(pt))
                for pt in offset_corners_1[:-1]
            ]
            offset_corners_2.append(offset_corners_2[0])  # Close the loop

            # Move the second offset downward
            offset_corners_2 = [
                pt + rg.Vector3d(0, 0, -downward_distance) for pt in offset_corners_2
            ]
            offset_curve_2 = rg.Polyline(offset_corners_2).ToNurbsCurve()
            offsets_2.append(offset_curve_2)

    return rectangles, offsets_1, offsets_2

# Parameters
#offset_distance = 0.1           # First inward offset distance
#second_offset_distance = 0.05   # Second inward offset distance
#downward_distance = 0.1         # Downward movement distance for the second offset

# Generate the projected grid, first offsets, and second offsets
rectangles, offsets_1, offsets_2 = project_and_offset_consistently(
    surface, grid_size_x, grid_size_y, cell_size, offset_distance, second_offset_distance, downward_distance
)

# Outputs
a = rectangles  # Original projected rectangles
b = offsets_1   # First inward-offset rectangles
c = offsets_2   # Second inward-offset rectangles, moved downward
# ---------- end iteration_8_18 ----------
geo_19 = Geometry(iteration_8_18.a)
geo_20 = Geometry(iteration_8_18.b)
geo_21 = Geometry(iteration_8_18.c)

number_slider_8 = Slider(15, range=0..100)
srf_5 = Surface(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)
iteration_8_16 = GhPythonScript(
    surface=srf_5,
    grid_size_x=number_slider_8,
    grid_size_y=number_slider_8,
    cell_size=Slider(4, range=1..10),
    offset_distance=Slider(0.711, range=0..1),
    second_offset_distance=Slider(1.5, range=0..10),
    downward_distance=Slider(2.91, range=0..4))  # -> out, a, b, c; inputs surface: Surface, grid_size_x: Int32, grid_size_y: Int32
# ---------- iteration_8_16: Python ----------
import Rhino.Geometry as rg

# Ensure the input surface is valid
if isinstance(surface, rg.Brep):
    # Convert Brep to a surface
    if len(surface.Faces) > 0:
        surface = surface.Faces[0].ToNurbsSurface()
elif isinstance(surface, rg.Surface):
    # The input is already a Surface
    surface = surface
else:
    raise ValueError("Please provide a valid Rhino Surface or Brep as input.")

# Function to project the grid onto the surface, offset twice, and move downward
def project_and_offset_twice(surface, grid_size_x, grid_size_y, cell_size, offset_distance, second_offset_distance, downward_distance):
    rectangles = []  # Original projected rectangles
    offsets_1 = []   # First inward offset
    offsets_2 = []   # Second inward offset + downward movement
    
    for i in range(grid_size_x):
        for j in range(grid_size_y):
            # Create flat grid points
            p1 = rg.Point3d(i * cell_size, j * cell_size, 0)
            p2 = rg.Point3d((i + 1) * cell_size, j * cell_size, 0)
            p3 = rg.Point3d((i + 1) * cell_size, (j + 1) * cell_size, 0)
            p4 = rg.Point3d(i * cell_size, (j + 1) * cell_size, 0)

            # Find corresponding UV coordinates on the surface
            _, u1, v1 = surface.ClosestPoint(p1)
            _, u2, v2 = surface.ClosestPoint(p2)
            _, u3, v3 = surface.ClosestPoint(p3)
            _, u4, v4 = surface.ClosestPoint(p4)

            # Project points onto the surface
            pt1 = surface.PointAt(u1, v1)
            pt2 = surface.PointAt(u2, v2)
            pt3 = surface.PointAt(u3, v3)
            pt4 = surface.PointAt(u4, v4)

            # Create the original rectangle
            original_corners = [pt1, pt2, pt3, pt4, pt1]
            original_curve = rg.Polyline(original_corners).ToNurbsCurve()
            rectangles.append(original_curve)

            # Offset the rectangle inward (first offset)
            plane = rg.Plane.FitPlaneToPoints(original_corners[:-1])[1]  # Fit plane to rectangle
            offset_curve_1 = original_curve.Offset(
                plane, 
                -offset_distance,  # Negative for inward offset
                0.01,  # Tolerance
                rg.CurveOffsetCornerStyle.Sharp
            )

            if offset_curve_1 and len(offset_curve_1) > 0:
                offset_1 = offset_curve_1[0]  # First offset result
                offsets_1.append(offset_1)

                # Offset the first offset inward again (second offset)
                offset_curve_2 = offset_1.Offset(
                    plane,
                    -second_offset_distance,  # Negative for inward offset
                    0.01,  # Tolerance
                    rg.CurveOffsetCornerStyle.Sharp
                )
                
                # Move the second offset downward
                if offset_curve_2 and len(offset_curve_2) > 0:
                    offset_2 = offset_curve_2[0]
                    offset_2.Translate(rg.Vector3d(0, 0, -downward_distance))  # Move downward
                    offsets_2.append(offset_2)

    return rectangles, offsets_1, offsets_2

# Parameters
offset_distance = 0.1           # Inward offset distance (first offset)
second_offset_distance = 0.05   # Further inward offset distance (second offset)
downward_distance = 0.1         # Downward movement distance for the second offset

# Generate the projected grid, first offsets, and second offsets
rectangles, offsets_1, offsets_2 = project_and_offset_twice(
    surface, grid_size_x, grid_size_y, cell_size, offset_distance, second_offset_distance, downward_distance
)

# Outputs
a = rectangles  # Original projected rectangles
b = offsets_1   # First inward-offset rectangles
c = offsets_2   # Second inward-offset rectangles, moved downward
# ---------- end iteration_8_16 ----------
geo_22 = Geometry(iteration_8_16.a)
geo_23 = Geometry(iteration_8_16.b)
geo_24 = Geometry(iteration_8_16.c)

number_slider_9 = Slider(15, range=0..100)
number_slider_10 = Slider(15, range=0..100)
srf_6 = Surface(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)
iteration_8_20 = GhPythonScript(
    surface=srf_6,
    grid_size_x=number_slider_9,
    grid_size_y=number_slider_9,
    cell_size=Slider(4, range=1..10),
    offset_distance=Slider(0.184, range=0..1),
    second_offset_distance=Slider(0.9, range=0..10),
    downward_distance=Slider(0.6, range=0..4))  # -> out, a, b, c, d, e; inputs surface: Surface, grid_size_x: Int32, grid_size_y: Int32
# ---------- iteration_8_20: Python ----------
import Rhino.Geometry as rg

# Ensure the input surface is valid
if isinstance(surface, rg.Brep):
    # Convert Brep to a surface
    if len(surface.Faces) > 0:
        surface = surface.Faces[0].ToNurbsSurface()
elif isinstance(surface, rg.Surface):
    # The input is already a Surface
    surface = surface
else:
    raise ValueError("Please provide a valid Rhino Surface or Brep as input.")

# Function to project vertically, offset twice, and loft
def project_offset_and_loft_vertically(surface, grid_size_x, grid_size_y, cell_size, offset_distance, second_offset_distance, downward_distance):
    rectangles = []  # Original projected rectangles
    offsets_1 = []   # First inward offset
    offsets_2 = []   # Second inward offset + downward movement
    lofts_1 = []     # Lofts between original and first offset
    lofts_2 = []     # Lofts between first and second offset

    for i in range(grid_size_x):
        for j in range(grid_size_y):
            # Create flat grid points
            p1 = rg.Point3d(i * cell_size, j * cell_size, 0)
            p2 = rg.Point3d((i + 1) * cell_size, j * cell_size, 0)
            p3 = rg.Point3d((i + 1) * cell_size, (j + 1) * cell_size, 0)
            p4 = rg.Point3d(i * cell_size, (j + 1) * cell_size, 0)

            # Project grid points vertically onto the surface
            def project_point_vertically(point, surface):
                vertical_line = rg.Line(point, point + rg.Vector3d(0, 0, -1000))  # Long vertical line downward
                intersections = rg.Intersect.Intersection.CurveSurface(
                    rg.LineCurve(vertical_line),
                    surface,
                    0.01,  # Tolerance
                    0.01   # Overlap tolerance
                )
                if intersections and intersections.Count > 0:
                    return intersections[0].PointA
                else:
                    raise ValueError("Projection failed: No intersection found.")
            
            # Project each corner of the rectangle
            pt1 = project_point_vertically(p1, surface)
            pt2 = project_point_vertically(p2, surface)
            pt3 = project_point_vertically(p3, surface)
            pt4 = project_point_vertically(p4, surface)

            # Compute the center of the grid cell
            cell_center = rg.Point3d((pt1.X + pt3.X) / 2, (pt1.Y + pt3.Y) / 2, (pt1.Z + pt3.Z) / 2)

            # Create the original rectangle
            original_corners = [pt1, pt2, pt3, pt4, pt1]
            original_curve = rg.Polyline(original_corners).ToNurbsCurve()
            rectangles.append(original_curve)

            # Offset each vertex toward the center (first inward offset)
            offset_corners_1 = [
                pt + (cell_center - pt) * (offset_distance / cell_center.DistanceTo(pt))
                for pt in [pt1, pt2, pt3, pt4]
            ]
            offset_corners_1.append(offset_corners_1[0])  # Close the loop
            offset_curve_1 = rg.Polyline(offset_corners_1).ToNurbsCurve()
            offsets_1.append(offset_curve_1)

            # Loft between original and first offset
            loft_1 = rg.Brep.CreateFromLoft(
                [original_curve, offset_curve_1],
                rg.Point3d.Unset,
                rg.Point3d.Unset,
                rg.LoftType.Normal,
                False
            )
            if loft_1 and len(loft_1) > 0:
                lofts_1.append(loft_1[0])

            # Offset the first offset inward again (second inward offset)
            offset_corners_2 = [
                pt + (cell_center - pt) * (second_offset_distance / cell_center.DistanceTo(pt))
                for pt in offset_corners_1[:-1]
            ]
            offset_corners_2.append(offset_corners_2[0])  # Close the loop

            # Move the second offset downward
            offset_corners_2 = [
                pt + rg.Vector3d(0, 0, -downward_distance) for pt in offset_corners_2
            ]
            offset_curve_2 = rg.Polyline(offset_corners_2).ToNurbsCurve()
            offsets_2.append(offset_curve_2)

            # Loft between first and second offset
            loft_2 = rg.Brep.CreateFromLoft(
                [offset_curve_1, offset_curve_2],
                rg.Point3d.Unset,
                rg.Point3d.Unset,
                rg.LoftType.Normal,
                False
            )
            if loft_2 and len(loft_2) > 0:
                lofts_2.append(loft_2[0])

    return rectangles, offsets_1, offsets_2, lofts_1, lofts_2

# Parameters
#offset_distance = 0.1           # First inward offset distance
#second_offset_distance = 0.05   # Second inward offset distance
#downward_distance = 0.1         # Downward movement distance for the second offset

# Generate the projected grid, offsets, and lofts
rectangles, offsets_1, offsets_2, lofts_1, lofts_2 = project_offset_and_loft_vertically(
    surface, grid_size_x, grid_size_y, cell_size, offset_distance, second_offset_distance, downward_distance
)

# Outputs
a = rectangles  # Original projec
# ---------- end iteration_8_20 ----------
geo_25 = Geometry(iteration_8_20.a)
geo_26 = Geometry(iteration_8_20.b)
geo_27 = Geometry(iteration_8_20.c)
geo_28 = Geometry(iteration_8_20.d)
geo_29 = Geometry(iteration_8_20.e)

number_slider_11 = Slider(20, range=0..100)
srf_7 = Surface(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)
iteration_8_12 = GhPythonScript(
    surface=srf_7,
    grid_size_x=number_slider_11,
    grid_size_y=number_slider_11,
    cell_size=Slider(4, range=1..10),
    offset_distance=Slider(1, range=0..1))  # -> out, a; inputs surface: Surface, grid_size_x: Int32, grid_size_y: Int32
# ---------- iteration_8_12: Python ----------
import Rhino.Geometry as rg

# Ensure the input surface is valid
if isinstance(surface, rg.Brep):
    # Convert Brep to a surface
    if len(surface.Faces) > 0:
        surface = surface.Faces[0].ToNurbsSurface()
elif isinstance(surface, rg.Surface):
    # The input is already a Surface
    surface = surface
else:
    raise ValueError("Please provide a valid Rhino Surface or Brep as input.")

# Function to project the grid onto the surface, offset, and loft
def project_and_loft(surface, grid_size_x, grid_size_y, cell_size, offset_distance):
    lofts = []
    for i in range(grid_size_x):
        for j in range(grid_size_y):
            # Create flat grid points
            p1 = rg.Point3d(i * cell_size, j * cell_size, 0)
            p2 = rg.Point3d((i + 1) * cell_size, j * cell_size, 0)
            p3 = rg.Point3d((i + 1) * cell_size, (j + 1) * cell_size, 0)
            p4 = rg.Point3d(i * cell_size, (j + 1) * cell_size, 0)

            # Find corresponding UV coordinates on the surface
            _, u1, v1 = surface.ClosestPoint(p1)
            _, u2, v2 = surface.ClosestPoint(p2)
            _, u3, v3 = surface.ClosestPoint(p3)
            _, u4, v4 = surface.ClosestPoint(p4)

            # Project points onto the surface
            pt1 = surface.PointAt(u1, v1)
            pt2 = surface.PointAt(u2, v2)
            pt3 = surface.PointAt(u3, v3)
            pt4 = surface.PointAt(u4, v4)

            # Create the original rectangle
            original_corners = [pt1, pt2, pt3, pt4, pt1]
            original_curve = rg.Polyline(original_corners).ToNurbsCurve()

            # Offset the rectangle inward along the surface's normal
            center_u = (u1 + u3) / 2
            center_v = (v1 + v3) / 2
            normal = surface.NormalAt(center_u, center_v)
            normal.Unitize()  # Normalize the normal vector

            # Calculate offset points
            offset_corners = [
                pt1 + (normal * -offset_distance),
                pt2 + (normal * -offset_distance),
                pt3 + (normal * -offset_distance),
                pt4 + (normal * -offset_distance),
                pt1 + (normal * -offset_distance)  # Close the loop
            ]
            offset_curve = rg.Polyline(offset_corners).ToNurbsCurve()

            # Loft between original and offset curves
            loft = rg.Brep.CreateFromLoft(
                [original_curve, offset_curve],
                rg.Point3d.Unset,
                rg.Point3d.Unset,
                rg.LoftType.Normal,
                False
            )
            if loft and len(loft) > 0:
                lofts.append(loft[0])  # Add the loft to the list
    return lofts

# Generate lofted geometry for the grid
lofts = project_and_loft(surface, grid_size_x, grid_size_y, cell_size, offset_distance)

# Outputs
a = lofts  # Lofted Breps
# ---------- end iteration_8_12 ----------

number_slider_12 = Slider(20, range=0..100)
srf_8 = Surface(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)
iteration_8_11 = GhPythonScript(
    surface=srf_8,
    grid_size_x=number_slider_12,
    grid_size_y=number_slider_12,
    cell_size=Slider(4, range=1..10),
    offset_distance=Slider(0.587, range=0..1))  # -> out, a; inputs surface: Surface, grid_size_x: Int32, grid_size_y: Int32
# ---------- iteration_8_11: Python ----------
import Rhino.Geometry as rg

# Ensure the input surface is valid
if isinstance(surface, rg.Brep):
    # Convert Brep to a surface
    if len(surface.Faces) > 0:
        surface = surface.Faces[0].ToNurbsSurface()
elif isinstance(surface, rg.Surface):
    # The input is already a Surface
    surface = surface
else:
    raise ValueError("Please provide a valid Rhino Surface or Brep as input.")

# Function to project the grid onto the surface, offset, and loft
def project_and_loft(surface, grid_size_x, grid_size_y, cell_size, offset_distance):
    lofts = []
    for i in range(grid_size_x):
        for j in range(grid_size_y):
            # Create flat grid points
            p1 = rg.Point3d(i * cell_size, j * cell_size, 0)
            p2 = rg.Point3d((i + 1) * cell_size, j * cell_size, 0)
            p3 = rg.Point3d((i + 1) * cell_size, (j + 1) * cell_size, 0)
            p4 = rg.Point3d(i * cell_size, (j + 1) * cell_size, 0)

            # Find corresponding UV coordinates on the surface
            _, u1, v1 = surface.ClosestPoint(p1)
            _, u2, v2 = surface.ClosestPoint(p2)
            _, u3, v3 = surface.ClosestPoint(p3)
            _, u4, v4 = surface.ClosestPoint(p4)

            # Project points onto the surface
            pt1 = surface.PointAt(u1, v1)
            pt2 = surface.PointAt(u2, v2)
            pt3 = surface.PointAt(u3, v3)
            pt4 = surface.PointAt(u4, v4)

            # Create the original rectangle
            original_corners = [pt1, pt2, pt3, pt4, pt1]
            original_curve = rg.Polyline(original_corners).ToNurbsCurve()

            # Offset the rectangle inward along the surface's normal
            normal = surface.NormalAt((u1 + u3) / 2, (v1 + v3) / 2)
            normal = normal.Unitize()
            offset_corners = [
                pt1 + normal * (-offset_distance),
                pt2 + normal * (-offset_distance),
                pt3 + normal * (-offset_distance),
                pt4 + normal * (-offset_distance),
                pt1 + normal * (-offset_distance)
            ]
            offset_curve = rg.Polyline(offset_corners).ToNurbsCurve()

            # Loft between original and offset curves
            loft = rg.Brep.CreateFromLoft(
                [original_curve, offset_curve],
                rg.Point3d.Unset,
                rg.Point3d.Unset,
                rg.LoftType.Normal,
                False
            )
            if loft and len(loft) > 0:
                lofts.append(loft[0])  # Add the loft to the list
    return lofts

# Generate lofted geometry for the grid
lofts = project_and_loft(surface, grid_size_x, grid_size_y, cell_size, offset_distance)

# Outputs
a = lofts  # Lofted Breps
# ---------- end iteration_8_11 ----------

number_slider_13 = Slider(20, range=0..100)
srf_9 = Surface(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)
iteration_8_13 = GhPythonScript(
    surface=srf_9,
    grid_size_x=number_slider_13,
    grid_size_y=number_slider_13,
    cell_size=Slider(4, range=1..10),
    offset_distance=Slider(1, range=0..1))  # -> out, a; inputs surface: Surface, grid_size_x: Int32, grid_size_y: Int32
# ---------- iteration_8_13: Python ----------
import Rhino.Geometry as rg

# Ensure the input surface is valid
if isinstance(surface, rg.Brep):
    # Convert Brep to a surface
    if len(surface.Faces) > 0:
        surface = surface.Faces[0].ToNurbsSurface()
elif isinstance(surface, rg.Surface):
    # The input is already a Surface
    surface = surface
else:
    raise ValueError("Please provide a valid Rhino Surface or Brep as input.")

# Function to project the grid onto the surface, offset inward, and loft
def project_and_loft(surface, grid_size_x, grid_size_y, cell_size, offset_distance):
    lofts = []
    for i in range(grid_size_x):
        for j in range(grid_size_y):
            # Create flat grid points
            p1 = rg.Point3d(i * cell_size, j * cell_size, 0)
            p2 = rg.Point3d((i + 1) * cell_size, j * cell_size, 0)
            p3 = rg.Point3d((i + 1) * cell_size, (j + 1) * cell_size, 0)
            p4 = rg.Point3d(i * cell_size, (j + 1) * cell_size, 0)

            # Find corresponding UV coordinates on the surface
            _, u1, v1 = surface.ClosestPoint(p1)
            _, u2, v2 = surface.ClosestPoint(p2)
            _, u3, v3 = surface.ClosestPoint(p3)
            _, u4, v4 = surface.ClosestPoint(p4)

            # Project points onto the surface
            pt1 = surface.PointAt(u1, v1)
            pt2 = surface.PointAt(u2, v2)
            pt3 = surface.PointAt(u3, v3)
            pt4 = surface.PointAt(u4, v4)

            # Create the original rectangle
            original_corners = [pt1, pt2, pt3, pt4, pt1]
            original_curve = rg.Polyline(original_corners).ToNurbsCurve()

            # Offset the rectangle inward within its plane
            offset_curve = original_curve.Offset(
                rg.Plane.FitPlaneToPoints(original_corners[:-1])[1],  # Fit a plane to the rectangle
                -offset_distance,  # Negative for inward offset
                0.01,  # Tolerance
                rg.CurveOffsetCornerStyle.Sharp
            )

            if offset_curve and len(offset_curve) > 0:
                offset_curve = offset_curve[0]  # Take the first result (offset)

                # Loft between original and offset curves
                loft = rg.Brep.CreateFromLoft(
                    [original_curve, offset_curve],
                    rg.Point3d.Unset,
                    rg.Point3d.Unset,
                    rg.LoftType.Normal,
                    False
                )
                if loft and len(loft) > 0:
                    lofts.append(loft[0])  # Add the loft to the list
    return lofts

# Generate lofted geometry for the grid
lofts = project_and_loft(surface, grid_size_x, grid_size_y, cell_size, offset_distance)

# Outputs
a = lofts  # Lofted Breps
# ---------- end iteration_8_13 ----------

number_slider_14 = Slider(20, range=0..100)
srf_10 = Surface(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)
iteration_8_10 = GhPythonScript(
    surface=srf_10,
    grid_size_x=number_slider_14,
    grid_size_y=number_slider_14,
    cell_size=Slider(4, range=1..10),
    offset_distance=Slider(0.587, range=0..1))  # -> out, a; inputs surface: Surface, grid_size_x: Int32, grid_size_y: Int32
# ---------- iteration_8_10: Python ----------
import Rhino.Geometry as rg

# Ensure the input surface is valid
if isinstance(surface, rg.Brep):
    # Convert Brep to a surface
    if len(surface.Faces) > 0:
        surface = surface.Faces[0].ToNurbsSurface()
elif isinstance(surface, rg.Surface):
    # The input is already a Surface
    surface = surface
else:
    raise ValueError("Please provide a valid Rhino Surface or Brep as input.")

# Function to project the grid onto the surface and offset/loft
def project_and_loft(surface, grid_size_x, grid_size_y, cell_size, offset_distance):
    lofts = []
    for i in range(grid_size_x):
        for j in range(grid_size_y):
            # Create flat grid points
            p1 = rg.Point3d(i * cell_size, j * cell_size, 0)
            p2 = rg.Point3d((i + 1) * cell_size, j * cell_size, 0)
            p3 = rg.Point3d((i + 1) * cell_size, (j + 1) * cell_size, 0)
            p4 = rg.Point3d(i * cell_size, (j + 1) * cell_size, 0)

            # Find corresponding UV coordinates on the surface
            _, u1, v1 = surface.ClosestPoint(p1)
            _, u2, v2 = surface.ClosestPoint(p2)
            _, u3, v3 = surface.ClosestPoint(p3)
            _, u4, v4 = surface.ClosestPoint(p4)

            # Project points onto the surface
            pt1 = surface.PointAt(u1, v1)
            pt2 = surface.PointAt(u2, v2)
            pt3 = surface.PointAt(u3, v3)
            pt4 = surface.PointAt(u4, v4)

            # Create the original rectangle
            original_corners = [pt1, pt2, pt3, pt4, pt1]
            original_curve = rg.Polyline(original_corners).ToNurbsCurve()

            # Offset the rectangle inward
            offset_curve = original_curve.Offset(
                rg.Plane.WorldXY,  # Assume world XY plane for simplicity
                -offset_distance,  # Negative for inward offset
                0.01,  # Tolerance
                rg.CurveOffsetCornerStyle.Sharp
            )

            if offset_curve and len(offset_curve) > 0:
                offset_curve = offset_curve[0]  # Take the first result (offset)

                # Loft between original and offset curves
                loft = rg.Brep.CreateFromLoft(
                    [original_curve, offset_curve],
                    rg.Point3d.Unset,
                    rg.Point3d.Unset,
                    rg.LoftType.Normal,
                    False
                )
                if loft and len(loft) > 0:
                    lofts.append(loft[0])  # Add the loft to the list
    return lofts

# Generate lofted geometry for the grid
lofts = project_and_loft(surface, grid_size_x, grid_size_y, cell_size, offset_distance)

# Outputs
a = lofts  # Lofted Breps
# ---------- end iteration_8_10 ----------

number_slider_15 = Slider(15, range=0..100)
srf_11 = Surface(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)
iteration_8_14 = GhPythonScript(
    surface=srf_11,
    grid_size_x=number_slider_15,
    grid_size_y=number_slider_15,
    cell_size=Slider(4, range=1..10),
    offset_distance=Slider(0.711, range=0..1))  # -> out, a, b; inputs surface: Surface, grid_size_x: Int32, grid_size_y: Int32
# ---------- iteration_8_14: Python ----------
import Rhino.Geometry as rg

# Ensure the input surface is valid
if isinstance(surface, rg.Brep):
    # Convert Brep to a surface
    if len(surface.Faces) > 0:
        surface = surface.Faces[0].ToNurbsSurface()
elif isinstance(surface, rg.Surface):
    # The input is already a Surface
    surface = surface
else:
    raise ValueError("Please provide a valid Rhino Surface or Brep as input.")

# Function to project the grid onto the surface and offset each cell inward
def project_and_offset(surface, grid_size_x, grid_size_y, cell_size, offset_distance):
    rectangles = []
    offsets = []
    
    for i in range(grid_size_x):
        for j in range(grid_size_y):
            # Create flat grid points
            p1 = rg.Point3d(i * cell_size, j * cell_size, 0)
            p2 = rg.Point3d((i + 1) * cell_size, j * cell_size, 0)
            p3 = rg.Point3d((i + 1) * cell_size, (j + 1) * cell_size, 0)
            p4 = rg.Point3d(i * cell_size, (j + 1) * cell_size, 0)

            # Find corresponding UV coordinates on the surface
            _, u1, v1 = surface.ClosestPoint(p1)
            _, u2, v2 = surface.ClosestPoint(p2)
            _, u3, v3 = surface.ClosestPoint(p3)
            _, u4, v4 = surface.ClosestPoint(p4)

            # Project points onto the surface
            pt1 = surface.PointAt(u1, v1)
            pt2 = surface.PointAt(u2, v2)
            pt3 = surface.PointAt(u3, v3)
            pt4 = surface.PointAt(u4, v4)

            # Create the original rectangle
            original_corners = [pt1, pt2, pt3, pt4, pt1]
            original_curve = rg.Polyline(original_corners).ToNurbsCurve()
            rectangles.append(original_curve)

            # Offset the rectangle inward within its plane
            plane = rg.Plane.FitPlaneToPoints(original_corners[:-1])[1]  # Fit plane to rectangle
            offset_curve = original_curve.Offset(
                plane, 
                -offset_distance,  # Negative for inward offset
                0.01,  # Tolerance
                rg.CurveOffsetCornerStyle.Sharp
            )

            # Check if offset was successful and add to the list
            if offset_curve and len(offset_curve) > 0:
                offsets.append(offset_curve[0])  # Add the first offset result

    return rectangles, offsets

# Parameters
offset_distance = 0.1  # Inward offset distance (adjustable)

# Generate the projected grid and offsets
rectangles, offsets = project_and_offset(surface, grid_size_x, grid_size_y, cell_size, offset_distance)

# Outputs
a = rectangles  # Original projected rectangles
b = offsets     # Offset rectangles
# ---------- end iteration_8_14 ----------

number_slider_16 = Slider(15, range=0..100)
srf_12 = Surface(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)
iteration_8_15 = GhPythonScript(
    surface=srf_12,
    grid_size_x=number_slider_16,
    grid_size_y=number_slider_16,
    cell_size=Slider(4, range=1..10),
    offset_distance=Slider(0.711, range=0..1))  # -> out, a, b; inputs surface: Surface, grid_size_x: Int32, grid_size_y: Int32
# ---------- iteration_8_15: Python ----------
import Rhino.Geometry as rg

# Ensure the input surface is valid
if isinstance(surface, rg.Brep):
    # Convert Brep to a surface
    if len(surface.Faces) > 0:
        surface = surface.Faces[0].ToNurbsSurface()
elif isinstance(surface, rg.Surface):
    # The input is already a Surface
    surface = surface
else:
    raise ValueError("Please provide a valid Rhino Surface or Brep as input.")

# Function to project the grid onto the surface and offset each cell inward
def project_and_offset_consistent(surface, grid_size_x, grid_size_y, cell_size, offset_distance):
    rectangles = []
    offsets = []

    for i in range(grid_size_x):
        for j in range(grid_size_y):
            # Create flat grid points
            p1 = rg.Point3d(i * cell_size, j * cell_size, 0)
            p2 = rg.Point3d((i + 1) * cell_size, j * cell_size, 0)
            p3 = rg.Point3d((i + 1) * cell_size, (j + 1) * cell_size, 0)
            p4 = rg.Point3d(i * cell_size, (j + 1) * cell_size, 0)

            # Find corresponding UV coordinates on the surface
            _, u1, v1 = surface.ClosestPoint(p1)
            _, u2, v2 = surface.ClosestPoint(p2)
            _, u3, v3 = surface.ClosestPoint(p3)
            _, u4, v4 = surface.ClosestPoint(p4)

            # Project points onto the surface
            pt1 = surface.PointAt(u1, v1)
            pt2 = surface.PointAt(u2, v2)
            pt3 = surface.PointAt(u3, v3)
            pt4 = surface.PointAt(u4, v4)

            # Create the original rectangle
            original_corners = [pt1, pt2, pt3, pt4, pt1]
            original_curve = rg.Polyline(original_corners).ToNurbsCurve()
            rectangles.append(original_curve)

            # Offset the rectangle inward within its plane
            plane = rg.Plane.FitPlaneToPoints(original_corners[:-1])[1]  # Fit plane to rectangle
            offset_curve = original_curve.Offset(
                plane, 
                -offset_distance,  # Negative for inward offset
                0.01,  # Tolerance
                rg.CurveOffsetCornerStyle.Sharp
            )

            if offset_curve and len(offset_curve) > 0:
                # Ensure the offset is inward
                offset = offset_curve[0]
                test_point = offset.PointAtStart
                if not original_curve.Contains(test_point, rg.Plane.WorldXY, 0.01) == rg.PointContainment.Inside:
                    # Reverse the offset distance to ensure inward direction
                    offset_curve = original_curve.Offset(
                        plane, 
                        offset_distance,  # Positive distance for inward
                        0.01, 
                        rg.CurveOffsetCornerStyle.Sharp
                    )
                    offset = offset_curve[0]

                offsets.append(offset)

    return rectangles, offsets

# Parameters
offset_distance = 0.1  # Inward offset distance (adjustable)

# Generate the projected grid and offsets
rectangles, offsets = project_and_offset_consistent(surface, grid_size_x, grid_size_y, cell_size, offset_distance)

# Outputs
a = rectangles  # Original projected rectangles
b = offsets     # Consistent inward-offset rectangles
# ---------- end iteration_8_15 ----------
geo_30 = Geometry([iteration_8_15.a, iteration_8_15.b])

number_slider_17 = Slider(20, range=0..100)
srf_13 = Surface(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)
iteration_8_5 = GhPythonScript(surface=srf_13, grid_size_x=number_slider_17, grid_size_y=number_slider_17, cell_size=Slider(3, range=1..10))  # -> out, a; inputs grid_size_x: Int32, grid_size_y: Int32
# ---------- iteration_8_5: Python ----------
import Rhino.Geometry as rg

# Inputs:
# 1. surface: The custom 3D surface to project the grid onto (input into Grasshopper).
# 2. grid_size_x: Number of subdivisions in the X direction.
# 3. grid_size_y: Number of subdivisions in the Y direction.
# 4. cell_size: The size of each grid cell.

# Check if a surface is provided
if surface is None:
    raise ValueError("Please provide a valid surface as input.")

# Function to project the grid onto a surface
def project_grid_onto_surface(surface, grid_size_x, grid_size_y, cell_size):
    rectangles = []
    for i in range(grid_size_x):
        for j in range(grid_size_y):
            # Calculate the 2D flat grid points
            p1 = rg.Point3d(i * cell_size, j * cell_size, 0)
            p2 = rg.Point3d((i + 1) * cell_size, j * cell_size, 0)
            p3 = rg.Point3d((i + 1) * cell_size, (j + 1) * cell_size, 0)
            p4 = rg.Point3d(i * cell_size, (j + 1) * cell_size, 0)
            
            # Map the flat points onto the 3D surface using UV coordinates
            u1, v1 = surface.ClosestPoint(p1)[1:3]
            u2, v2 = surface.ClosestPoint(p2)[1:3]
            u3, v3 = surface.ClosestPoint(p3)[1:3]
            u4, v4 = surface.ClosestPoint(p4)[1:3]
            
            pt1 = surface.PointAt(u1, v1)
            pt2 = surface.PointAt(u2, v2)
            pt3 = surface.PointAt(u3, v3)
            pt4 = surface.PointAt(u4, v4)
            
            # Create a rectangle from the projected points
            rect_corners = [pt1, pt2, pt3, pt4, pt1]
            rect = rg.Polyline(rect_corners).ToNurbsCurve()
            rectangles.append(rect)
    return rectangles

# Generate the projected grid on the input surface
rectangles = project_grid_onto_surface(surface, grid_size_x, grid_size_y, cell_size)

# Outputs
a = rectangles  # Output the projected grid as a list of rectangles
# ---------- end iteration_8_5 ----------

number_slider_18 = Slider(20, range=0..100)
srf_14 = Surface(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)
iteration_8_6 = GhPythonScript(surface=srf_14, grid_size_x=number_slider_18, grid_size_y=number_slider_18, cell_size=Slider(3, range=1..10))  # -> out, a; inputs grid_size_x: Int32, grid_size_y: Int32
# ---------- iteration_8_6: Python ----------
import Rhino.Geometry as rg
import scriptcontext as sc
import Rhino

# Inputs:
# 1. surface: The custom 3D surface to project the grid onto (input as a Rhino surface).
# 2. grid_size_x: Number of subdivisions in the X direction.
# 3. grid_size_y: Number of subdivisions in the Y direction.
# 4. cell_size: The size of each grid cell.

# Ensure the surface is a valid Rhino surface
if isinstance(surface, Rhino.DocObjects.ObjRef):
    surface = surface.Geometry  # Convert the reference to a geometry object

# Ensure the surface is a Brep or Surface
if not isinstance(surface, rg.Surface):
    raise ValueError("Please provide a valid Rhino surface.")

# Function to project the grid onto a surface
def project_grid_onto_surface(surface, grid_size_x, grid_size_y, cell_size):
    rectangles = []
    for i in range(grid_size_x):
        for j in range(grid_size_y):
            # Calculate the 2D flat grid points
            p1 = rg.Point3d(i * cell_size, j * cell_size, 0)
            p2 = rg.Point3d((i + 1) * cell_size, j * cell_size, 0)
            p3 = rg.Point3d((i + 1) * cell_size, (j + 1) * cell_size, 0)
            p4 = rg.Point3d(i * cell_size, (j + 1) * cell_size, 0)
            
            # Map the flat points onto the 3D surface using UV coordinates
            _, u1, v1 = surface.ClosestPoint(p1)
            _, u2, v2 = surface.ClosestPoint(p2)
            _, u3, v3 = surface.ClosestPoint(p3)
            _, u4, v4 = surface.ClosestPoint(p4)
            
            pt1 = surface.PointAt(u1, v1)
            pt2 = surface.PointAt(u2, v1)
            pt3 = surface.PointAt(u3, v3)
            pt4 = surface.PointAt(u4, v3)
            
            # Create a rectangle from the projected points
            rect_corners = [pt1, pt2, pt3, pt4, pt1]
            rect = rg.Polyline(rect_corners).ToNurbsCurve()
            rectangles.append(rect)
    return rectangles

# Generate the projected grid on the input surface
rectangles = project_grid_onto_surface(surface, grid_size_x, grid_size_y, cell_size)

# Outputs
a = rectangles  # Output the projected grid as a list of rectangles
# ---------- end iteration_8_6 ----------

number_slider_19 = Slider(20, range=0..100)
srf_15 = Surface(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)
iteration_8_7 = GhPythonScript(surface=srf_15, grid_size_x=number_slider_19, grid_size_y=number_slider_19, cell_size=Slider(4, range=1..10))  # -> out, a; inputs surface: Surface, grid_size_x: Int32, grid_size_y: Int32
# ---------- iteration_8_7: Python ----------
import Rhino.Geometry as rg

# Inputs:
# surface: The input surface to project the grid onto (can be Brep or Surface).
# grid_size_x: Number of subdivisions in the X direction.
# grid_size_y: Number of subdivisions in the Y direction.
# cell_size: Size of each grid cell.

# Ensure the input surface is valid
if isinstance(surface, rg.Brep):
    # Convert Brep to a surface
    if len(surface.Faces) > 0:
        surface = surface.Faces[0].ToNurbsSurface()
elif isinstance(surface, rg.Surface):
    # The input is already a Surface
    surface = surface
else:
    raise ValueError("Please provide a valid Rhino Surface or Brep as input.")

# Function to project the grid onto the surface
def project_grid_onto_surface(surface, grid_size_x, grid_size_y, cell_size):
    rectangles = []
    for i in range(grid_size_x):
        for j in range(grid_size_y):
            # Create flat grid points
            p1 = rg.Point3d(i * cell_size, j * cell_size, 0)
            p2 = rg.Point3d((i + 1) * cell_size, j * cell_size, 0)
            p3 = rg.Point3d((i + 1) * cell_size, (j + 1) * cell_size, 0)
            p4 = rg.Point3d(i * cell_size, (j + 1) * cell_size, 0)

            # Find corresponding UV coordinates on the surface
            _, u1, v1 = surface.ClosestPoint(p1)
            _, u2, v2 = surface.ClosestPoint(p2)
            _, u3, v3 = surface.ClosestPoint(p3)
            _, u4, v4 = surface.ClosestPoint(p4)

            # Project points onto the surface
            pt1 = surface.PointAt(u1, v1)
            pt2 = surface.PointAt(u2, v2)
            pt3 = surface.PointAt(u3, v3)
            pt4 = surface.PointAt(u4, v4)

            # Create a rectangle from the projected points
            rect_corners = [pt1, pt2, pt3, pt4, pt1]
            rect = rg.Polyline(rect_corners).ToNurbsCurve()
            rectangles.append(rect)
    return rectangles

# Generate the grid of rectangles projected onto the surface
rectangles = project_grid_onto_surface(surface, grid_size_x, grid_size_y, cell_size)

# Outputs
a = rectangles  # Projected rectangles
# ---------- end iteration_8_7 ----------

number_slider_20 = Slider(20, range=0..100)
srf_16 = Surface(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)
iteration_8_8 = GhPythonScript(surface=srf_16, grid_size_x=number_slider_20, grid_size_y=number_slider_20, cell_size=Slider(4, range=1..10))  # -> out, a; inputs surface: Surface, grid_size_x: Int32, grid_size_y: Int32
# ---------- iteration_8_8: Python ----------
import Rhino.Geometry as rg

# Ensure the input surface is valid
if isinstance(surface, rg.Brep):
    # Convert Brep to a surface
    if len(surface.Faces) > 0:
        surface = surface.Faces[0].ToNurbsSurface()
elif isinstance(surface, rg.Surface):
    # The input is already a Surface
    surface = surface
else:
    raise ValueError("Please provide a valid Rhino Surface or Brep as input.")

# Function to create 3D panels on the surface
def create_3d_panels_on_surface(surface, grid_size_x, grid_size_y, cell_size):
    panels = []
    for i in range(grid_size_x):
        for j in range(grid_size_y):
            # Create flat grid points
            p1 = rg.Point3d(i * cell_size, j * cell_size, 0)
            p2 = rg.Point3d((i + 1) * cell_size, j * cell_size, 0)
            p3 = rg.Point3d((i + 1) * cell_size, (j + 1) * cell_size, 0)
            p4 = rg.Point3d(i * cell_size, (j + 1) * cell_size, 0)

            # Find corresponding UV coordinates on the surface
            _, u1, v1 = surface.ClosestPoint(p1)
            _, u2, v2 = surface.ClosestPoint(p2)
            _, u3, v3 = surface.ClosestPoint(p3)
            _, u4, v4 = surface.ClosestPoint(p4)

            # Project points onto the surface
            pt1 = surface.PointAt(u1, v1)
            pt2 = surface.PointAt(u2, v2)
            pt3 = surface.PointAt(u3, v3)
            pt4 = surface.PointAt(u4, v4)

            # Create a panel surface from the projected points
            corner_points = [pt1, pt2, pt3, pt4, pt1]
            panel_curve = rg.Polyline(corner_points).ToNurbsCurve()
            panel = rg.Brep.CreateFromCornerPoints(pt1, pt2, pt3, pt4, 0.01)
            panels.append(panel)
    return panels

# Generate the 3D panels on the surface
panels = create_3d_panels_on_surface(surface, grid_size_x, grid_size_y, cell_size)

# Outputs
a = panels  # Output the 3D panels as Breps
# ---------- end iteration_8_8 ----------

number_slider_21 = Slider(20, range=0..100)
srf_17 = Surface(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)
iteration_8_9 = GhPythonScript(surface=srf_17, grid_size_x=number_slider_21, grid_size_y=number_slider_21, cell_size=Slider(4, range=1..10))  # -> out, a; inputs surface: Surface, grid_size_x: Int32, grid_size_y: Int32
# ---------- iteration_8_9: Python ----------
import Rhino.Geometry as rg

# Ensure the input surface is valid
if isinstance(surface, rg.Brep):
    # Convert Brep to a surface
    if len(surface.Faces) > 0:
        surface = surface.Faces[0].ToNurbsSurface()
elif isinstance(surface, rg.Surface):
    # The input is already a Surface
    surface = surface
else:
    raise ValueError("Please provide a valid Rhino Surface or Brep as input.")

# Function to project the grid onto the surface and offset/loft
def project_and_loft(surface, grid_size_x, grid_size_y, cell_size, offset_distance):
    lofts = []
    for i in range(grid_size_x):
        for j in range(grid_size_y):
            # Create flat grid points
            p1 = rg.Point3d(i * cell_size, j * cell_size, 0)
            p2 = rg.Point3d((i + 1) * cell_size, j * cell_size, 0)
            p3 = rg.Point3d((i + 1) * cell_size, (j + 1) * cell_size, 0)
            p4 = rg.Point3d(i * cell_size, (j + 1) * cell_size, 0)

            # Find corresponding UV coordinates on the surface
            _, u1, v1 = surface.ClosestPoint(p1)
            _, u2, v2 = surface.ClosestPoint(p2)
            _, u3, v3 = surface.ClosestPoint(p3)
            _, u4, v4 = surface.ClosestPoint(p4)

            # Project points onto the surface
            pt1 = surface.PointAt(u1, v1)
            pt2 = surface.PointAt(u2, v2)
            pt3 = surface.PointAt(u3, v3)
            pt4 = surface.PointAt(u4, v4)

            # Create the original rectangle
            original_corners = [pt1, pt2, pt3, pt4, pt1]
            original_curve = rg.Polyline(original_corners).ToNurbsCurve()

            # Offset the rectangle inward
            offset_curve = original_curve.Offset(
                rg.Plane.WorldXY,  # Assume world XY plane for simplicity
                -offset_distance,  # Negative for inward offset
                0.01,  # Tolerance
                rg.CurveOffsetCornerStyle.Sharp
            )

            if offset_curve and len(offset_curve) > 0:
                offset_curve = offset_curve[0]  # Take the first result (offset)

                # Loft between original and offset curves
                loft = rg.Brep.CreateFromLoft(
                    [original_curve, offset_curve],
                    rg.Point3d.Unset,
                    rg.Point3d.Unset,
                    rg.LoftType.Normal,
                    False
                )
                if loft and len(loft) > 0:
                    lofts.append(loft[0])  # Add the loft to the list
    return lofts

# Parameters
offset_distance = 0.2  # Distance to offset inward

# Generate lofted geometry for the grid
lofts = project_and_loft(surface, grid_size_x, grid_size_y, cell_size, offset_distance)

# Outputs
a = lofts  # Lofted Breps
# ---------- end iteration_8_9 ----------

# ----
# Case Study 8:  Deformed Coffered Grid (p. 231)
iteration_8_1 = GhPythonScript()  # -> out, a
# ---------- iteration_8_1: Python ----------
import math
import Rhino.Geometry as rg

# Input parameters
grid_size = 10       # Number of grid cells (NxN)
cell_size = 5.0      # Size of each cell
wave_amplitude = 2.0 # Height of the wave
wave_frequency = 1.0 # Frequency of the wave

# Outputs
points = []
rectangles = []

# Generate the grid
for i in range(grid_size):
    for j in range(grid_size):
        # Calculate the base point
        x = i * cell_size
        y = j * cell_size
        
        # Apply a sine wave transformation to the z-coordinate
        z = wave_amplitude * math.sin(wave_frequency * i) * math.cos(wave_frequency * j)
        point = rg.Point3d(x, y, z)
        points.append(point)
        
        # Create rectangles (cells)
        if (i + j) % 2 == 0:  # Alternate pattern
            rect_corners = [
                rg.Point3d(x, y, z),
                rg.Point3d(x + cell_size, y, z),
                rg.Point3d(x + cell_size, y + cell_size, z),
                rg.Point3d(x, y + cell_size, z)
            ]
            rect = rg.Polyline(rect_corners + [rect_corners[0]]).ToNurbsCurve()
            rectangles.append(rect)
# ---------- end iteration_8_1 ----------
iteration_8_2_2 = GhPythonScript()  # -> out, a
# ---------- iteration_8_2_2: Python ----------
import math
import Rhino.Geometry as rg

# Input parameters
grid_size = 10       # Number of grid cells (NxN)
cell_size = 5.0      # Size of each cell
wave_amplitude = 2.0 # Height of the wave
wave_frequency = 1.0 # Frequency of the wave

# Outputs
rectangles = []  # List to store all rectangle panels

# Generate the grid
for i in range(grid_size):
    for j in range(grid_size):
        # Calculate the base point
        x = i * cell_size
        y = j * cell_size
        
        # Apply a sine wave transformation to the z-coordinate
        z = wave_amplitude * math.sin(wave_frequency * i) * math.cos(wave_frequency * j)
        
        # Create rectangles (cells)
        if (i + j) % 2 == 0:  # Alternate pattern
            rect_corners = [
                rg.Point3d(x, y, z),
                rg.Point3d(x + cell_size, y, z),
                rg.Point3d(x + cell_size, y + cell_size, z),
                rg.Point3d(x, y + cell_size, z)
            ]
            rect = rg.Polyline(rect_corners + [rect_corners[0]]).ToNurbsCurve()
            rectangles.append(rect)

# Assign rectangles to the output
a = rectangles
# ---------- end iteration_8_2_2 ----------
iteration_8_3 = GhPythonScript()  # -> out, a, b
# ---------- iteration_8_3: Python ----------
import Rhino.Geometry as rg

# Input parameters
grid_size_x = 10     # Number of cells in the X direction
grid_size_y = 10     # Number of cells in the Y direction
cell_size = 1.0      # Size of each cell
wave_amplitude = 2.0 # Amplitude of the wave surface
wave_frequency = 0.2 # Frequency of the wave surface

# Create a wave surface
def create_wave_surface(size_x, size_y, cell_size, wave_amplitude, wave_frequency):
    points = []
    for i in range(size_x + 1):
        row = []
        for j in range(size_y + 1):
            x = i * cell_size
            y = j * cell_size
            # Apply wave-like variation to the Z-coordinate
            z = wave_amplitude * rg.Point3d(x, y, 0).DistanceTo(rg.Point3d(size_x * cell_size / 2, size_y * cell_size / 2, 0)) * wave_frequency
            row.append(rg.Point3d(x, y, z))
        points.append(row)
    
    # Generate a NURBS surface from points
    nurbs_surface = rg.NurbsSurface.CreateFromPoints(
        [pt for row in points for pt in row],
        grid_size_x + 1,
        grid_size_y + 1,
        3, 3  # Degree of the surface in U and V
    )
    return nurbs_surface

# Create a grid of rectangles
def create_grid_on_surface(surface, grid_size_x, grid_size_y, cell_size):
    rectangles = []
    for i in range(grid_size_x):
        for j in range(grid_size_y):
            # Evaluate the surface to get 4 corner points for each cell
            u1 = i / grid_size_x
            v1 = j / grid_size_y
            u2 = (i + 1) / grid_size_x
            v2 = (j + 1) / grid_size_y
            
            pt1 = surface.PointAt(u1, v1)
            pt2 = surface.PointAt(u2, v1)
            pt3 = surface.PointAt(u2, v2)
            pt4 = surface.PointAt(u1, v2)
            
            # Create a rectangle from the 4 points
            rect_corners = [pt1, pt2, pt3, pt4, pt1]
            rect = rg.Polyline(rect_corners).ToNurbsCurve()
            rectangles.append(rect)
    return rectangles

# Create the wave surface
wave_surface = create_wave_surface(grid_size_x, grid_size_y, cell_size, wave_amplitude, wave_frequency)

# Generate the grid of rectangles on the surface
rectangles = create_grid_on_surface(wave_surface, grid_size_x, grid_size_y, cell_size)

# Output the surface and rectangles
a = wave_surface  # Output the surface (for visualization)
b = rectangles    # Output the rectangles (grid projected on the surface)
# ---------- end iteration_8_3 ----------
iteration_8_4 = GhPythonScript()  # -> out, a, b
# ---------- iteration_8_4: Python ----------
import Rhino.Geometry as rg

# Input parameters
grid_size_x = 10     # Number of cells in the X direction
grid_size_y = 10     # Number of cells in the Y direction
cell_size = 1.0      # Size of each cell
wave_amplitude = 2.0 # Amplitude of the wave surface
wave_frequency = 0.2 # Frequency of the wave surface

# Create a wave surface
def create_wave_surface(grid_size_x, grid_size_y, cell_size, wave_amplitude, wave_frequency):
    control_points = []
    for i in range(grid_size_x + 1):
        row = []
        for j in range(grid_size_y + 1):
            x = i * cell_size
            y = j * cell_size
            z = wave_amplitude * rg.Point3d(x, y, 0).DistanceTo(rg.Point3d(grid_size_x * cell_size / 2, grid_size_y * cell_size / 2, 0)) * wave_frequency
            row.append(rg.Point3d(x, y, z))
        control_points.append(row)
    
    # Convert points into a NURBS surface
    nurbs_surface = rg.NurbsSurface.CreateFromPoints(
        [pt for row in control_points for pt in row],
        grid_size_x + 1,
        grid_size_y + 1,
        3, 3  # Degree of the surface in U and V
    )
    return nurbs_surface

# Project a flat grid onto the surface
def project_grid_onto_surface(surface, grid_size_x, grid_size_y, cell_size):
    rectangles = []
    for i in range(grid_size_x):
        for j in range(grid_size_y):
            # Get grid points in 2D (flat grid)
            p1 = rg.Point3d(i * cell_size, j * cell_size, 0)
            p2 = rg.Point3d((i + 1) * cell_size, j * cell_size, 0)
            p3 = rg.Point3d((i + 1) * cell_size, (j + 1) * cell_size, 0)
            p4 = rg.Point3d(i * cell_size, (j + 1) * cell_size, 0)
            
            # Map points onto the surface (projecting from flat grid to 3D)
            u1, v1 = surface.ClosestPoint(p1)[1:3]
            u2, v2 = surface.ClosestPoint(p2)[1:3]
            u3, v3 = surface.ClosestPoint(p3)[1:3]
            u4, v4 = surface.ClosestPoint(p4)[1:3]
            
            pt1 = surface.PointAt(u1, v1)
            pt2 = surface.PointAt(u2, v2)
            pt3 = surface.PointAt(u3, v3)
            pt4 = surface.PointAt(u4, v4)
            
            # Create a rectangle from the projected points
            rect_corners = [pt1, pt2, pt3, pt4, pt1]
            rect = rg.Polyline(rect_corners).ToNurbsCurve()
            rectangles.append(rect)
    return rectangles

# Create the wave surface
wave_surface = create_wave_surface(grid_size_x, grid_size_y, cell_size, wave_amplitude, wave_frequency)

# Generate the projected grid on the surface
rectangles = project_grid_onto_surface(wave_surface, grid_size_x, grid_size_y, cell_size)

# Output the surface and rectangles
a = wave_surface  # Output the 3D surface
b = rectangles    # Output the projected grid (rectangles)
# ---------- end iteration_8_4 ----------
geo_31 = Geometry(iteration_8_3.b)
geo_32 = Geometry(iteration_8_4.b)
